# Grasshopper definition example-01-basic-rf-systems.ghx (Grasshopper 1.0.8)
# Copyright: Lorin Wiedemeier

# ---- group: Tri Remesh (Rhino-GH)
srf_trim = Geometry(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)
triremesh = TriRemesh(Geometry=srf_trim, Length=Slider(0.96, range=0.01..10), Iterations=25)  # -> Triangulation, Dual, Creases
py_compas = CompasPyTemplate(mesh=triremesh.Triangulation)  # -> mesh; inputs mesh: GeometryBase
# ---------- py_compas: Python ----------
# r: compas==2.15.0,compas_timber==1.0.4
# venv: ca-fs26

from compas_rhino.devtools import DevTools
DevTools.ensure_path()
ghenv.Component.Message = "To COMPAS Mesh"

# ------ IMPORTS -------

from compas_rhino.conversions import mesh_to_compas

# --------------------------------------------------
# ------------------- EXECUTION --------------------

mesh = mesh_to_compas(mesh)
# ---------- end py_compas ----------
py_compas_2 = CompasPyTemplate(mesh=triremesh.Dual)  # -> mesh, geo; inputs mesh: GeometryBase
# ---------- py_compas_2: Python ----------
# r: compas==2.15.0,compas_timber==1.0.4
# venv: ca-fs26

from compas_rhino.devtools import DevTools
DevTools.ensure_path()
ghenv.Component.Message = "NGon to Mesh"

# ------ IMPORTS -------

from compas_rhino.conversions import mesh_to_compas
from compas_rhino.conversions import mesh_to_rhino
from compas_rhino.conversions import vector_to_compas

# --------------------------------------------------
# ------------------- EXECUTION --------------------
from compas.datastructures import Mesh

def mesh_to_compas_ngon(rhinomesh):
    mesh = Mesh()
    mesh.update_default_vertex_attributes(normal=None, color=None)
    mesh.update_default_face_attributes(normal=None)

    vertexcolors = rhinomesh.VertexColors
    if not vertexcolors:
        vertexcolors = [None] * rhinomesh.Vertices.Count

    for vertex, normal, color in zip(rhinomesh.Vertices, rhinomesh.Normals, vertexcolors):
        mesh.add_vertex(
            x=float(vertex.X),
            y=float(vertex.Y),
            z=float(vertex.Z),
            normal=vector_to_compas(normal),
        )

    facenormals = rhinomesh.FaceNormals
    if not facenormals:
        facenormals = [None] * rhinomesh.Faces.Count

    used_face_indices = set()

    for ngon in rhinomesh.Ngons:
        try:
            fi = list(ngon.FaceIndexList())
        except TypeError:
            fi = list(ngon.FaceIndexList)
        used_face_indices.update(fi)

        try:
            bvi = list(ngon.BoundaryVertexIndexList())
        except TypeError:
            bvi = list(ngon.BoundaryVertexIndexList)
        except AttributeError:
            bvi = [ngon.BoundaryVertexIndex(k) for k in range(ngon.BoundaryVertexCount)]

        # Guard: ignore degenerate ngons
        if len(bvi) >= 3:
            mesh.add_face(bvi, normal=None) # TODO: For now, no normal

    for fid, (face, normal) in enumerate(zip(rhinomesh.Faces, facenormals)):
        if fid in used_face_indices:
            continue
        if face.IsTriangle:
            vertices = [face.A, face.B, face.C]
        else:
            # print(face)
            vertices = [face.A, face.B, face.C, face.D]
        mesh.add_face(vertices, normal=vector_to_compas(normal) if normal else None)

    for key in rhinomesh.UserDictionary:
        mesh.attributes[key] = rhinomesh.UserDictionary[key]

    return mesh

mesh = mesh_to_compas_ngon(mesh)
geo = mesh_to_rhino(mesh, disjoint=False)
# ---------- end py_compas_2 ----------

# ---- group: Quad Remesh (Rhino-GH)
srf_trim_2 = Geometry(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)
quad_remesh_settings = QuadRemeshSettings(
    TargetCount=Slider(200, range=10..600),
    AdaptiveSize=0,
    AdaptiveCount=False,
    HardEdges=False,
    SeamEdges=0,
    Symmetry=0,
    GuideCurves=0)
quad_remesh = QuadRemesh(Geometry=srf_trim_2, Settings=quad_remesh_settings)
py_compas_3 = CompasPyTemplate(mesh=quad_remesh)  # -> mesh; inputs mesh: GeometryBase; same code as py_compas

# ---- group: Mesh from Grid
mesh_from_grid = Python3Script(count=Slider(10, range=0..10), size=Slider(8, range=0..20))  # -> mesh, rhino_mesh; inputs count: Int32, size: Int32
# ---------- mesh_from_grid: Python ----------
# r: compas==2.15.0,compas_timber==1.0.4
# venv: ca-fs26

from compas_rhino.devtools import DevTools
DevTools.ensure_path()
ghenv.Component.Message = "Minimal mesh"

# -----

from compas.datastructures import Mesh
from compas_rhino.conversions import mesh_to_rhino


mesh = Mesh.from_meshgrid(count, size)

# mesh.quads_to_triangles()
# mesh = mesh.dual(include_boundary=True)

# Output
rhino_mesh = mesh_to_rhino(mesh, disjoint=False)
# ---------- end mesh_from_grid ----------

# ----
compas_mesh = Data(mesh_from_grid.mesh)

# ---- group: Mesh to RF System
# Mesh to RF Examples
# Gramazio Kohler Research
# Gonzalo Casas, Lorin Wiedemeier, Eric Gozzi
number_slider = Slider(0.02, range=0..0.1)
mesh_to_rf_system = Python3Script(mesh=compas_mesh, tolerance=number_slider, process_joinery=Toggle(False))  # -> timber_model, beams
# ---------- mesh_to_rf_system: Python ----------
# r: compas==2.15.0,compas_timber==1.0.4
# venv: ca-fs26

from compas_rhino.devtools import DevTools
DevTools.ensure_path()
ghenv.Component.Message = "Mesh to RF example"

# -----

from a01_rf_system import RFSystem
from a01_timber_model import TimberModelCreator

rf_system = RFSystem(mesh)
rf_system.create_rf_datastructure()
rf_system.eccentrize_centerlines(0.2)
rf_system.extend_centerlines(0.2)

creator = TimberModelCreator(rf_system, tolerance=tolerance)
timber_model = creator.create_timber_model(process_joinery=process_joinery)

# Output
beams = []
for beam in timber_model.beams:
    try:
        beams.append(beam.geometry)
    except:
        print("Beam geometry could not be generated")
# ---------- end mesh_to_rf_system ----------
draw = COMPASDraw(cg=mesh_to_rf_system.beams)  # -> rg
#   port cg: The COMPAS geometry or datastructure to be drawn.
#   port rg: The Rhino geometry object.
# ---------- draw: Python ----------
# r: compas==2.15.0,compas_timber==1.0.4
# venv: ca-fs26

from typing import Any

import Grasshopper

from compas.scene import SceneObject


class CompasToRhinoGeometry(Grasshopper.Kernel.GH_ScriptInstance):
    def RunScript(self, cg):
        if not cg:
            return None

        return SceneObject(item=cg).draw()
# ---------- end draw ----------

# ----
reloader = CompasDevReloader()
# ---------- reloader: Python ----------
"""
------------------------------
Using VS Code as Python editor
------------------------------

The simplest way to start using VS Code as our editor, is
to place our Python code in files located IN THE SAME FOLDER as our Grasshopper file.

After we have done that, we need 2 steps: 

1. Enable the COMPAS reloader on one component. This tells Grasshopper to watch for changes in the Pythoh files and reload if changed.
2. Every other component that uses Python code from external files needs to start with a method to ensure Grasshopper knows where to load the files from.

"""
# r: compas==2.15.0,compas_timber==1.0.4
# venv: ca-fs26

from compas_rhino.devtools import DevTools
DevTools.enable_reloader()
# ---------- end reloader ----------
