# Grasshopper definition example-02-visualizer-components.ghx (Grasshopper 1.0.8)
# Copyright: Lorin Wiedemeier

point = Point(Point(1.289836698, -0.8822927553, 1.562951195))
cylinder = Cylinder(Base=point, Radius=Slider(2.3, range=0.1..20), Length=1)
cap = CapHoles(Brep=cylinder)
brep = Brep(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)
trim_solid = TrimSolid(Shape=brep, Cutters=cap)

quad_remesh = QuadRemesh(Geometry=trim_solid, Settings={aqc=True, as=50, dhe=True, gci=0, null=False, pme=2, sa=0, tqc=2000})
remeshbycolour = RemeshByColour(Mesh=quad_remesh, LengthInterval=Domain(0.5, 2), Flip=1, Iterations=1, Reset=True)
py_compas = CompasPyTemplate(mesh=remeshbycolour)  # -> mesh; inputs mesh: GeometryBase
# ---------- py_compas: Python ----------
# r: compas==2.15.0,compas_timber==1.0.4
# venv: ca-fs26

from compas_rhino.devtools import DevTools
DevTools.ensure_path()
ghenv.Component.Message = "To COMPAS Mesh"

# ------ IMPORTS -------

from compas_rhino.conversions import mesh_to_compas

# --------------------------------------------------
# ------------------- EXECUTION --------------------

mesh = mesh_to_compas(mesh)
# ---------- end py_compas ----------

# ---- group: UV / Brep Meshing
brep_2 = Brep(trim_solid)
srf = Surface(reparameterize(brep_2))
py_compas_2 = CompasPyTemplate(x_brep=srf, u_div=Slider(6, range=0..10), v_div=Slider(6, range=0..10), target_index=Slider(7, range=0..100))  # inputs x_brep: Brep, u_div: Int32, v_div: Int32, target_index: Int32, bake: Boolean
# ---------- py_compas_2: Python ----------
"""Grasshopper Script Instance"""
import System
import Rhino
import Rhino.Geometry
import Grasshopper

class MyComponent(Grasshopper.Kernel.GH_ScriptInstance):

    def RunScript(self,
            x_brep: Rhino.Geometry.Brep,
            u_div: int,
            v_div: int,
            target_index: int,
            bake: bool):
        
        self._points = []        
        self._labels = []
        self._highlight_mesh = None
        
        if not x_brep or x_brep.Faces.Count == 0:
            return None

        u_count = max(2, u_div)
        v_count = max(2, v_div)

        face = x_brep.Faces[0]
        surf = face.UnderlyingSurface()
        u_dom = surf.Domain(0)
        v_dom = surf.Domain(1)
        
        # Scale for 3D Text Bake
        bbox = x_brep.GetBoundingBox(True)
        self._text_height = bbox.Diagonal.Length * 0.015

        # 1. Grid Generation
        grid = []
        flat_points = []
        counter = 0
        for i in range(u_count):
            row = []
            u_f = i / float(u_count - 1)
            u_p = u_dom.Min + (u_dom.Max - u_dom.Min) * u_f
            for j in range(v_count):
                v_f = j / float(v_count - 1)
                v_p = v_dom.Min + (v_dom.Max - v_dom.Min) * v_f
                pt = surf.PointAt(u_p, v_p)
                row.append(pt)
                flat_points.append(pt)
                self._labels.append(("{} : u: {:.2f}, v: {:.2f}".format(counter, u_p, v_p), pt))
                counter += 1
            grid.append(row)
        self._points = flat_points

        # 2. Quad Generation
        if 0 <= target_index < len(flat_points):
            i, j = target_index // v_count, target_index % v_count
            if i < u_count - 1 and j < v_count - 1:
                m = Rhino.Geometry.Mesh()
                m.Vertices.Add(grid[i][j]); m.Vertices.Add(grid[i][j+1])
                m.Vertices.Add(grid[i+1][j+1]); m.Vertices.Add(grid[i+1][j])
                m.Faces.AddFace(0, 1, 2, 3)
                self._highlight_mesh = m

        if bake:
            self.bake_geometry()
        return self._highlight_mesh

    def bake_geometry(self):
        doc = Rhino.RhinoDoc.ActiveDoc
        parent_name = "UV_Explorer"
        pv_color = System.Drawing.Color.MediumOrchid

        def get_or_create_layer(full_path, color):
            idx = doc.Layers.FindByFullPath(full_path, -1)
            if idx >= 0: return idx
            
            # Recursive layer creation for parent/child
            parts = full_path.split("::")
            current_path = ""
            parent_id = System.Guid.Empty
            
            last_idx = -1
            for part in parts:
                current_path = (current_path + "::" + part) if current_path else part
                found = doc.Layers.FindByFullPath(current_path, -1)
                if found < 0:
                    new_layer = Rhino.DocObjects.Layer()
                    new_layer.Name = part
                    new_layer.ParentLayerId = parent_id
                    new_layer.Color = color
                    found = doc.Layers.Add(new_layer)
                parent_id = doc.Layers[found].Id
                last_idx = found
            return last_idx

        # Define Layer Indices
        pt_idx = get_or_create_layer(parent_name + "::Points", System.Drawing.Color.Black)
        txt_idx = get_or_create_layer(parent_name + "::Labels", System.Drawing.Color.Black)
        face_idx = get_or_create_layer(parent_name + "::Selected_Face", pv_color)

        def get_attr(l_idx):
            attr = Rhino.DocObjects.ObjectAttributes()
            attr.LayerIndex = l_idx
            # FORCE object to use layer color, not active color
            attr.ColorSource = Rhino.DocObjects.ObjectColorSource.ColorFromLayer
            return attr

        # Bake Points
        for pt in self._points:
            doc.Objects.AddPoint(pt, get_attr(pt_idx))

        # Bake Mesh
        if self._highlight_mesh:
            doc.Objects.AddMesh(self._highlight_mesh, get_attr(face_idx))

        # Bake Text
        for txt, pt in self._labels:
            plane = Rhino.Geometry.Plane.WorldXY
            plane.Origin = pt
            te = Rhino.Geometry.TextEntity()
            te.PlainText = txt
            te.Plane = plane
            te.TextHeight = self._text_height
            doc.Objects.AddText(te, get_attr(txt_idx))

        doc.Views.Redraw()

    def DrawViewportWires(self, args):
        r = 3
        for pt in self._points:
            args.Display.DrawPoint(pt, Rhino.Display.PointStyle.Circle, r + 1.5, System.Drawing.Color.Black)
            args.Display.DrawPoint(pt, Rhino.Display.PointStyle.Circle, r, System.Drawing.Color.White)
        if self._highlight_mesh:
            args.Display.DrawMeshWires(self._highlight_mesh, System.Drawing.Color.DarkViolet, 2)

    def DrawViewportMeshes(self, args):
        if self._highlight_mesh:
            pv = System.Drawing.Color.FromArgb(120, 218, 112, 214) 
            args.Display.DrawMeshShaded(self._highlight_mesh, Rhino.Display.DisplayMaterial(pv))
        for txt, pt in self._labels:
            s_pt = args.Viewport.WorldToClient(pt)
            args.Display.Draw2dText(txt, System.Drawing.Color.Black, Rhino.Geometry.Point2d(s_pt.X, s_pt.Y + 30), True, 20)
# ---------- end py_compas_2 ----------

brep_3 = Brep(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)
srf_2 = Surface(reparameterize(brep_3))
py_compas_3 = CompasPyTemplate(x_brep=srf_2, u_div=Slider(6, range=0..10), v_div=Slider(6, range=0..10))  # inputs x_brep: Brep, u_div: Int32, v_div: Int32, bake: Boolean
# ---------- py_compas_3: Python ----------
"""Grasshopper Script Instance"""
import System
import Rhino
import Rhino.Geometry
import Grasshopper

class MyComponent(Grasshopper.Kernel.GH_ScriptInstance):

    def RunScript(self,
            x_brep: Rhino.Geometry.Brep,
            u_div: int,
            v_div: int,
            bake: bool):
        
        self._points = []        
        self._labels = []        
        
        if not x_brep or x_brep.Faces.Count == 0:
            return None

        # Number of points along each direction
        u_count = max(2, u_div)
        v_count = max(2, v_div)

        face = x_brep.Faces[0]
        surf = face.UnderlyingSurface()
        
        u_dom = surf.Domain(0)
        v_dom = surf.Domain(1)
        
        counter = 0
        for i in range(u_count):
            u_factor = i / float(u_count - 1)
            u_p = u_dom.Min + (u_dom.Max - u_dom.Min) * u_factor
            
            for j in range(v_count):
                v_factor = j / float(v_count - 1)
                v_p = v_dom.Min + (v_dom.Max - v_dom.Min) * v_factor
                
                pt = surf.PointAt(u_p, v_p)
                self._points.append(pt)
                
                # --- UPDATED LABEL FORMAT ---
                # Format: "number" : u: "uvalue", v: "vvalue"
                label_text = "{} : u: {:.2f}, v: {:.2f}".format(counter, u_p, v_p)
                self._labels.append((label_text, pt))
                
                counter += 1

        if bake:
            self.bake_geometry()

        return None

    def bake_geometry(self):
        doc = Rhino.RhinoDoc.ActiveDoc
        layer_name = "UV_Grid_Points"
        idx = doc.Layers.FindByFullPath(layer_name, -1)
        if idx < 0:
            idx = doc.Layers.Add(layer_name, System.Drawing.Color.Black)
        
        attr = Rhino.DocObjects.ObjectAttributes()
        attr.LayerIndex = idx
        for pt in self._points:
            doc.Objects.AddPoint(pt, attr)
        doc.Views.Redraw()

    def DrawViewportWires(self, args):
        # Point Stylings: Round white with black outline
        inner_color = System.Drawing.Color.White
        outline_color = System.Drawing.Color.Black
        radius_pixels = 3 # Slightly bigger as requested
        
        for pt in self._points:
            # Draw Black Outline (the "base")
            args.Display.DrawPoint(pt, Rhino.Display.PointStyle.Circle, radius_pixels + 1.5, outline_color)
            # Draw White Center (the "fill")
            args.Display.DrawPoint(pt, Rhino.Display.PointStyle.Circle, radius_pixels, inner_color)

    def DrawViewportMeshes(self, args):
        # Label Stylings: Black and positioned below the point
        text_color = System.Drawing.Color.Black
        font_size = 20
        
        for txt, pt in self._labels:
            # Convert 3D point to 2D screen location
            screen_pt = args.Viewport.WorldToClient(pt)
            # Offset 30 pixels down in screen space
            offset_pt = Rhino.Geometry.Point2d(screen_pt.X, screen_pt.Y + 30)
            
            args.Display.Draw2dText(txt, text_color, offset_pt, True, font_size)
# ---------- end py_compas_3 ----------

# Example 02 - Visualizer Components
# Gramazio Kohler Research
# Gonzalo Casas, Lorin Wiedemeier, Eric Gozzi
brep_4 = Brep(trim_solid)
srf_3 = Surface(reparameterize(brep_4))
py_compas_4 = CompasPyTemplate(x_brep=srf_3, u_val=Slider(0.68, range=0..1), v_val=Slider(0.4, range=0..1))  # inputs x_brep: Brep, u_val: Double, v_val: Double, bake: Boolean
# ---------- py_compas_4: Python ----------
"""Grasshopper Script Instance"""
import System
import Rhino
import Rhino.Geometry
import Grasshopper

class MyComponent(Grasshopper.Kernel.GH_ScriptInstance):

    def RunScript(self,
            x_brep: Rhino.Geometry.Brep,
            u_val: float,
            v_val: float,
            bake: bool):
        self._curves = []        
        self._labels = []        
        
        if not x_brep or x_brep.Faces.Count == 0:
            return None

        face = x_brep.Faces[0]
        surf = face.UnderlyingSurface()
        
        u_domain = surf.Domain(0)
        v_domain = surf.Domain(1)
        
        # Current coordinate values
        u_param = u_domain.Min + (u_domain.Max - u_domain.Min) * u_val
        v_param = v_domain.Min + (v_domain.Max - v_domain.Min) * v_val
        
        # --- SWAPPED LOGIC FOR INTUITION ---
        # Moving U slider -> Draws the curve at that U (which runs in V direction)
        # Moving V slider -> Draws the curve at that V (which runs in U direction)
        
        # Constant U = 0 (The curve that slides when U changes)
        iso_at_u = surf.IsoCurve(0, u_param) 
        # Constant V = 1 (The curve that slides when V changes)
        iso_at_v = surf.IsoCurve(1, v_param) 
        
        center_pt = surf.PointAt(u_domain.Mid, v_domain.Mid)

        def add_labeled_curve(crv, color, label_text):
            if not crv: return
            self._curves.append((crv, color, 3))
            
            # Offset Logic
            start = crv.PointAtStart
            vec_offset = start - center_pt
            if vec_offset.Length > 0:
                vec_offset.Unitize()
                text_pos = start + (vec_offset * 0.5)
            else:
                text_pos = start
                
            self._labels.append((label_text, text_pos, color, 20))

        # We now label the curve that "responds" to the slider
        # Red line = Your U position
        add_labeled_curve(iso_at_u, System.Drawing.Color.Red, "U: {:.2f}".format(u_param))
        # Green line = Your V position
        add_labeled_curve(iso_at_v, System.Drawing.Color.Green, "V: {:.2f}".format(v_param))

        if bake:
            self.bake_geometry(iso_at_u, iso_at_v)

        return None

    def bake_geometry(self, iso_u, iso_v):
        doc = Rhino.RhinoDoc.ActiveDoc
        def bake_item(geo, name, col):
            if not geo: return
            idx = doc.Layers.FindByFullPath(name, -1)
            if idx < 0: 
                L = Rhino.DocObjects.Layer()
                L.Name = name.split("::")[-1]
                L.Color = col
                idx = doc.Layers.Add(L)
            attr = Rhino.DocObjects.ObjectAttributes()
            attr.LayerIndex = idx
            doc.Objects.AddCurve(geo, attr)

        bake_item(iso_u, "UV_Explorer::U_Indicator", System.Drawing.Color.Red)
        bake_item(iso_v, "UV_Explorer::V_Indicator", System.Drawing.Color.Green)
        doc.Views.Redraw()

    def DrawViewportWires(self, args):
        for crv, col, thk in self._curves:
            args.Display.DrawCurve(crv, col, thk)

    def DrawViewportMeshes(self, args):
        for txt, pt, col, sz in self._labels:
            args.Display.Draw2dText(txt, col, pt, True, sz)
# ---------- end py_compas_4 ----------

# ---- group: topology explorer (prev. edge - next edge)
mesh = Data(py_compas)
py_compas_5 = CompasPyTemplate(mesh=mesh, f_index=Slider(7, range=0..100), e_index=Slider(2, range=0..6))  # inputs f_index: Int32, e_index: Int32
# ---------- py_compas_5: Python ----------
"""Grasshopper Script Instance"""
import System
import Rhino
import Rhino.Geometry
import Grasshopper

from compas_rhino.conversions import point_to_rhino

class MyComponent(Grasshopper.Kernel.GH_ScriptInstance):

    def RunScript(self, mesh, f_index: int, e_index: int):
        """
        Inputs:
            mesh: compas.datastructures.Mesh
            f_index: int (Face Index)
            e_index: int (Edge Index)
            bake: bool (Bake to Rhino)
        """
        ghenv.Component.Message = "Topo Explorer"
        
        # --- Storage for Draw ---
        self._lines = []        
        self._main_labels = []  # Navigation labels (Selected, Next, etc.)
        self._index_labels = [] # Face-local edge indices
        self._face_labels = []  # Global Face indices
        self._vertex_labels = [] # Global Vertex indices
        
        if not mesh:
            return

        # ------------------------------------------------
        # 0. DRAW ALL MESH EDGES (Background Wireframe)
        # ------------------------------------------------
        wire_color = System.Drawing.Color.FromArgb(180, 180, 180) 
        
        for u, v in mesh.edges():
            p_u = point_to_rhino(mesh.vertex_attributes(u, 'xyz'))
            p_v = point_to_rhino(mesh.vertex_attributes(v, 'xyz'))
            self._lines.append((Rhino.Geometry.Line(p_u, p_v), wire_color, 1))

        # ------------------------------------------------
        # 1. GLOBAL VISUALIZATION 
        # ------------------------------------------------
        for fkey in mesh.faces():
            pt = mesh.face_centroid(fkey)
            self._face_labels.append((str(fkey), point_to_rhino(pt), System.Drawing.Color.Blue, 35))
            
        for vkey in mesh.vertices():
            pt = mesh.vertex_point(vkey)
            self._vertex_labels.append((str(vkey), point_to_rhino(pt), System.Drawing.Color.Magenta, 30))

        # ------------------------------------------------
        # 2. TOPO NAVIGATION LOGIC
        # ------------------------------------------------
        def get_face_centroid(f_key):
            pts = [mesh.vertex_attributes(v, 'xyz') for v in mesh.face_vertices(f_key)]
            c = [sum(axis)/len(axis) for axis in zip(*pts)]
            return point_to_rhino(c)

        def add_face_indices(f_key, color):
            center = get_face_centroid(f_key)
            vertices = mesh.face_vertices(f_key)
            for i in range(len(vertices)):
                p_u = point_to_rhino(mesh.vertex_attributes(vertices[i], 'xyz'))
                p_v = point_to_rhino(mesh.vertex_attributes(vertices[(i + 1) % len(vertices)], 'xyz'))
                mid = (p_u + p_v) / 2.0
                vec_to_center = center - mid
                text_loc = mid + (vec_to_center * 0.15)
                self._index_labels.append((str(i), text_loc, color, 22))

        if f_index is not None and e_index is not None:
            try:
                f_keys = list(mesh.faces())
                if f_index >= len(f_keys): raise IndexError
                f_key = f_keys[f_index]
                
                f_vtx = mesh.face_vertices(f_key)
                if e_index >= len(f_vtx):
                    self.AddRuntimeMessage(Grasshopper.Kernel.GH_RuntimeMessageLevel.Warning, "Edge Index out of range")
                else:
                    # Highlight active face indices
                    add_face_indices(f_key, System.Drawing.Color.DarkGreen)

                    # --- A. Selected Edge (Black) ---
                    u, v = f_vtx[e_index], f_vtx[(e_index + 1) % len(f_vtx)]
                    p1, p2 = point_to_rhino(mesh.vertex_attributes(u, 'xyz')), point_to_rhino(mesh.vertex_attributes(v, 'xyz'))
                    
                    self._lines.append((Rhino.Geometry.Line(p1, p2), System.Drawing.Color.Black, 6))
                    self._main_labels.append(("*Selected*", (p1+p2)/2, System.Drawing.Color.Black, 24))

                    # --- B. Next Edge (Blue) ---
                    w = f_vtx[(e_index + 2) % len(f_vtx)]
                    p3 = point_to_rhino(mesh.vertex_attributes(w, 'xyz'))
                    
                    self._lines.append((Rhino.Geometry.Line(p2, p3), System.Drawing.Color.DodgerBlue, 4))
                    # Added Label Here:
                    self._main_labels.append(("Next Edge", (p2+p3)/2, System.Drawing.Color.DodgerBlue, 20))
                    
                    # --- C. Previous Edge (Red) ---
                    adj_face = mesh.halfedge_face((v, u))
                    if adj_face is not None:
                        add_face_indices(adj_face, System.Drawing.Color.DarkRed)
                        adj_vtx = mesh.face_vertices(adj_face)
                        if u in adj_vtx:
                            u_idx = adj_vtx.index(u)
                            z = adj_vtx[(u_idx + 1) % len(adj_vtx)]
                            p_z = point_to_rhino(mesh.vertex_attributes(z, 'xyz'))
                            
                            self._lines.append((Rhino.Geometry.Line(p1, p_z), System.Drawing.Color.Red, 4))
                            # Renamed Label Here:
                            self._main_labels.append(("Prev. Edge", (p1+p_z)/2, System.Drawing.Color.Red, 20))
                    else:
                        self._main_labels.append(("Boundary", (p1+p2)/2, System.Drawing.Color.Gray, 18))
            
            except IndexError:
                self.AddRuntimeMessage(Grasshopper.Kernel.GH_RuntimeMessageLevel.Warning, "Face Index out of range")

        return None

    def bake_geometry(self):
        doc = Rhino.RhinoDoc.ActiveDoc
        
        def get_or_create_layer(layer_path, color):
            parts = layer_path.split("::")
            parent_id = System.Guid.Empty
            current_path = ""
            last_index = -1
            for part in parts:
                current_path = (current_path + "::" + part) if current_path else part
                idx = doc.Layers.FindByFullPath(current_path, -1)
                if idx < 0:
                    new_layer = Rhino.DocObjects.Layer()
                    new_layer.Name = part
                    if parent_id != System.Guid.Empty:
                        new_layer.ParentLayerId = parent_id
                    new_layer.Color = color
                    idx = doc.Layers.Add(new_layer)
                parent_id = doc.Layers[idx].Id
                last_index = idx
            return last_index

        def bake_obj(geo, layer_name, color):
            attr = Rhino.DocObjects.ObjectAttributes()
            attr.LayerIndex = get_or_create_layer(layer_name, color)
            attr.ColorSource = Rhino.DocObjects.ObjectColorSource.ColorFromLayer
            
            if isinstance(geo, Rhino.Geometry.Line):
                doc.Objects.AddLine(geo, attr)
            elif isinstance(geo, Rhino.Geometry.TextEntity):
                doc.Objects.AddText(geo, attr)

        def create_3d_text(text, pt, size):
            # Scale pixel size to Rhino units - significantly reduced factor
            height = size * 0.005 
            plane = Rhino.Geometry.Plane.WorldXY
            plane.Origin = pt
            
            te = Rhino.Geometry.TextEntity()
            te.PlainText = text
            te.Plane = plane
            te.Justification = Rhino.Geometry.TextJustification.MiddleCenter
            # Set font height
            te.Font = doc.Fonts[doc.Fonts.FindOrCreate("Arial", False, False)]
            te.TextHeight = height
            return te

        # 1. Bake wireframe
        wireframe_color = System.Drawing.Color.FromArgb(180, 180, 180)
        for line, color, _ in self._lines:
            bake_obj(line, "Topo::Wireframe", color)

        # 2. Bake Face Indices
        for text, pt, color, size in self._face_labels:
            te = create_3d_text(text, pt, size)
            bake_obj(te, "Topo::Global_Indices::Faces", color)

        # 3. Bake Vertex Indices
        for text, pt, color, size in self._vertex_labels:
            te = create_3d_text(text, pt, size)
            bake_obj(te, "Topo::Global_Indices::Vertices", color)

        # 4. Bake Local Face Indices
        for text, pt, color, size in self._index_labels:
            te = create_3d_text(text, pt, size)
            bake_obj(te, "Topo::Local_Indices", color)

        # 5. Bake Navigation Labels
        for text, pt, color, size in self._main_labels:
            te = create_3d_text(text, pt, size)
            bake_obj(te, "Topo::Navigation", color)

        doc.Views.Redraw()

    def IsPreviewCapable(self):
        return Grasshopper.Kernel.GH_PreviewCapability.Disabled

    def DrawViewportWires(self, args):
        if hasattr(self, "_lines"):
            for line, color, thickness in self._lines:
                args.Display.DrawLine(line, color, thickness)

    def DrawViewportMeshes(self, args):
        # 1. Global Face Indices
        if hasattr(self, "_face_labels"):
            for text, pt, color, size in self._face_labels:
                args.Display.Draw2dText(text, color, pt, True, size)
        
        # 2. Global Vertex Indices
        if hasattr(self, "_vertex_labels"):
            for text, pt, color, size in self._vertex_labels:
                args.Display.Draw2dText(text, color, pt, True, size)

        # 3. Local Edge Indices (0, 1, 2...)
        if hasattr(self, "_index_labels"):
            for text, pt, color, size in self._index_labels:
                args.Display.Draw2dText(text, color, pt, True, size)

        # 4. Navigation Status Labels
        if hasattr(self, "_main_labels"):
            for text, pt, color, size in self._main_labels:
                args.Display.Draw2dText(text, color, pt, True, size)

    def AfterRunScript(self):
        self.MaintainDrawSettings = True
# ---------- end py_compas_5 ----------

# ---- group: Dual Mesh
dual_mesh = Python3Script(x=quad_remesh)  # -> out, a; inputs x: Mesh
# ---------- dual_mesh: Python ----------
from compas_rhino.conversions import mesh_to_compas
from compas_rhino.conversions import mesh_to_rhino

mesh = mesh_to_compas(x)
mesh = mesh.dual()
a = mesh_to_rhino(mesh, disjoint=False)
# ---------- end dual_mesh ----------

# ----
reloader = CompasDevReloader()
# ---------- reloader: Python ----------
"""
------------------------------
Using VS Code as Python editor
------------------------------

The simplest way to start using VS Code as our editor, is
to place our Python code in files located IN THE SAME FOLDER as our Grasshopper file.

After we have done that, we need 2 steps: 

1. Enable the COMPAS reloader on one component. This tells Grasshopper to watch for changes in the Pythoh files and reload if changed.
2. Every other component that uses Python code from external files needs to start with a method to ensure Grasshopper knows where to load the files from.

"""
# r: compas==2.15.0,compas_timber==1.0.4
# venv: ca-fs26

from compas_rhino.devtools import DevTools
DevTools.enable_reloader()
# ---------- end reloader ----------
