# Grasshopper definition 01_compas_timber_examples.ghx (Grasshopper 1.0.8)
# Copyright: Lorin Wiedemeier

# ----
# Elements
# Beams to be joined
# directly joining
# elements
geo = Geometry([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])
# joining elements
# by category
number_slider = Slider(2, range=0..10)
geo_2 = Geometry([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])
geo_3 = Geometry([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])
# joining lists of
# elements
mbox = MeshBox(Base={Plane=PlaneXY(0, 0, 0), X=Domain(-10, 10), Y=Domain(-10, 10), Z=Domain(-10, 10)}, XCount=1, YCount=1, ZCount=1)
ct_beam = CTBeam(centerline=geo, width=Slider(1, range=0..1), height=Slider(2, range=0..10))  # -> Beam, Blank; inputs centerline: list, z_vector: list of Vector3d, width: list of Double, height: list of Double, category: list of String, updateRefObj: Boolean
#   port centerline: Referenced curve or line, Guid of curve or line in the active Rhino document.
#   port z_vector: Vector defining the orientation of the cross-section (corresponds to the height dimension). If None, a default will be taken.
#   port width: Width of the cross-section (usually the smaller dimension).
#   port height: Height of the cross-section (usually the larger dimension).
#   port category: Category of a beam.
#   port updateRefObj: (optional) If True, the attributes in the referenced object will be updated/overwritten with the new values given here.
#   port Beam: Beam object(s).
#   port Blank: Shape of the beam's blank.
# ---------- ct_beam: Python ----------
# r: compas==2.15.0,compas_timber==1.0.4
# venv: ca-fs26
"""Creates a Beam from a LineCurve."""

# flake8: noqa
import Grasshopper
import Rhino
import rhinoscriptsyntax as rs
import System
from compas.scene import Scene
from compas_rhino.conversions import line_to_compas
from compas_rhino.conversions import vector_to_compas

from compas_timber.elements import Beam as CTBeam
from compas_timber.ghpython.rhino_object_name_attributes import update_rhobj_attributes_name
from compas_timber.ghpython.ghcomponent_helpers import list_input_valid_cpython


class Beam_fromCurve(Grasshopper.Kernel.GH_ScriptInstance):
    def RunScript(self,
            centerline: System.Collections.Generic.List[object],
            z_vector: System.Collections.Generic.List[Rhino.Geometry.Vector3d],
            width: System.Collections.Generic.List[float],
            height: System.Collections.Generic.List[float],
            category: System.Collections.Generic.List[str],
            updateRefObj: bool):
        # minimum inputs required
        if not list_input_valid_cpython(ghenv, centerline, "Centerline"):
            return
        if not width:
            length = self._get_centerline_length(centerline)
            width = [length / 20]
        if not height:
            length = self._get_centerline_length(centerline)
            height = [length / 10]

        # reformat unset parameters for consistency
        if not z_vector:
            z_vector = [None]
        if not category:
            category = [None]

        beams = []
        blanks = []
        scene = Scene()

        if centerline and height and width:
            # check list lengths for consistency
            N = len(centerline)
            if len(z_vector) not in (0, 1, N):
                ghenv.Component.AddRuntimeMessage(
                    Grasshopper.Kernel.GH_RuntimeMessageLevel.Error, " In 'ZVector' I need either none, one or the same number of inputs as the Crv parameter."
                )
            if len(width) not in (1, N):
                ghenv.Component.AddRuntimeMessage(Grasshopper.Kernel.GH_RuntimeMessageLevel.Error, " In 'W' I need either one or the same number of inputs as the Crv parameter.")
            if len(height) not in (1, N):
                ghenv.Component.AddRuntimeMessage(Grasshopper.Kernel.GH_RuntimeMessageLevel.Error, " In 'H' I need either one or the same number of inputs as the Crv parameter.")
            if len(category) not in (0, 1, N):
                ghenv.Component.AddRuntimeMessage(
                    Grasshopper.Kernel.GH_RuntimeMessageLevel.Error, " In 'Category' I need either none, one or the same number of inputs as the Crv parameter."
                )

            # duplicate data if None or single value
            if len(z_vector) != N:
                z_vector = [z_vector[0] for _ in range(N)]
            if len(width) != N:
                width = [width[0] for _ in range(N)]
            if len(height) != N:
                height = [height[0] for _ in range(N)]
            if len(category) != N:
                category = [category[0] for _ in range(N)]

            for line, z, w, h, c in zip(centerline, z_vector, width, height, category):
                guid, geometry = self._get_guid_and_geometry(line)
                rhino_line = rs.coerceline(geometry)
                line = line_to_compas(rhino_line)

                z = vector_to_compas(z) if z else None
                beam = CTBeam.from_centerline(centerline=line, width=w, height=h, z_vector=z)
                beam.attributes["rhino_guid"] = str(guid) if guid else None
                beam.attributes["category"] = c
                if updateRefObj and guid:
                    update_rhobj_attributes_name(guid, "width", str(w))
                    update_rhobj_attributes_name(guid, "height", str(h))
                    update_rhobj_attributes_name(guid, "zvector", str(list(beam.frame.zaxis)))
                    update_rhobj_attributes_name(guid, "category", c)

                beams.append(beam)
                scene.add(beam.blank)

        blanks = scene.draw()

        return beams, blanks

    def _get_guid_and_geometry(self, line):
        # internalized curves and GH geometry will not have persistent GUIDs, referenced Rhino objects will
        # type hint on the input has to be 'ghdoc' for this to work
        guid = None
        geometry = line
        rhino_obj = Rhino.RhinoDoc.ActiveDoc.Objects.FindId(line)
        if rhino_obj:
            guid = line
            geometry = rhino_obj.Geometry
        return guid, geometry

    def _get_centerline_length(self, centerline):
        centerline_length = []
        for i in centerline:
            centerline_length.append(rs.CurveLength(i))
        if centerline_length:
            length_average = sum(centerline_length) / len(centerline_length)
        else:
            length_average = 1
        return length_average
# ---------- end ct_beam ----------
ct_beam_2 = CTBeam(centerline=geo_3, width=Slider(1, range=0..1), height=number_slider, category="outer")  # -> Beam, Blank; inputs centerline: list, z_vector: list of Vector3d, width: list of Double, height: list of Double, category: list of String, updateRefObj: Boolean; same code as ct_beam
ct_beam_3 = CTBeam(centerline=geo_2, width=Slider(1, range=0..1), height=Slider(2, range=0..10), category="inner")  # -> Beam, Blank; inputs centerline: list, z_vector: list of Vector3d, width: list of Double, height: list of Double, category: list of String, updateRefObj: Boolean; same code as ct_beam
ct_beamsfrommeshedges = CTBeamsFromMeshEdges(mesh=mbox, width=Slider(1, range=0..1), height=Slider(2, range=0..10))  # -> Beams, BeamMap, Blanks; inputs mesh: Mesh, width: Double, height: Double, category: String
#   port mesh: Mesh whose edges are used to generate beams.
#   port width: Width of beams
#   port height: Height of beams
#   port category: Category assigned to beams that can be used to define joint rules.
#   port Beams: List of compas_timber Beams.
#   port BeamMap: a Data Tree with the beams organized by connection to a mesh vertex. Used to define joint rules using the Joint_Rules_From_List component.
#   port Blanks: Base beam geometry before adding features or joining operations
# ---------- ct_beamsfrommeshedges: Python ----------
# r: compas==2.15.0,compas_timber==1.0.4
# venv: ca-fs26
"""Creates a data-tree structure of Beams from edges of a Mesh."""

# flake8: noqa
import Grasshopper
import Rhino
import rhinoscriptsyntax as rs
from compas.geometry import Line
from compas.geometry import Vector
from compas.scene import Scene
from Grasshopper import DataTree
from Grasshopper.Kernel.Data import GH_Path

from compas_timber.elements import Beam
from compas_timber.ghpython.ghcomponent_helpers import item_input_valid_cpython


class BeamTreeFromMesh(Grasshopper.Kernel.GH_ScriptInstance):
    def RunScript(self,
            mesh: Rhino.Geometry.Mesh,
            width: float,
            height: float,
            category: str):
        # minimum inputs required
        if not item_input_valid_cpython(ghenv, mesh, "mesh"):
            return
        if not item_input_valid_cpython(ghenv, width, "width"):
            return
        if not item_input_valid_cpython(ghenv, height, "height"):
            return
        edge_index_pairs = []

        points = rs.MeshVertices(mesh)
        faces = rs.MeshFaceVertices(mesh)
        normals = rs.MeshFaceNormals(mesh)

        points, pt_map = set_map(points)
        faces = [[pt_map[i] for i in face] for face in faces]

        for face in faces:  # get all the edges of the mesh
            for ind in range(len(face)):
                edge_set = set([face[ind - 1], face[ind]])
                if edge_set not in edge_index_pairs:
                    edge_index_pairs.append(edge_set)

        beam_Zs = []
        for pair in edge_index_pairs:  # get the z direction of the beam using the average of the adjacent face normals
            normal = Vector(0, 0, 0)
            count = 0
            for i, face in enumerate(faces):
                face = set(face)
                if pair.issubset(face):
                    count += 1
                    normal += normals[i]
            beam_Zs.append(normal * (1 / count))

        scene = Scene()
        beam_list = []
        for edge, z in zip(edge_index_pairs, beam_Zs):  # create the beams from the edges
            edge = Line(points[list(edge)[0]], points[list(edge)[1]])
            beam = Beam.from_centerline(edge, width, height, z)
            if category:
                beam.attributes["category"] = category
            beam_list.append(beam)
            scene.add(beam.blank)

        beam_tree = []
        for i in range(len(points)):  # map the beams to the vertices. Each vertex will have a list of beams that are connected to it
            joint_beams = []
            for j, pair in enumerate(edge_index_pairs):
                if i in pair:
                    joint_beams.append(beam_list[j])
            beam_tree.append(joint_beams)

        dt = DataTree[object]()
        for i, beam_branch in enumerate(beam_tree):
            dt.AddRange(beam_branch, GH_Path(i))

        blanks = scene.draw()
        return beam_list, dt, blanks


def set_map(points):
    pts_out = []
    inds_out = []
    for i, pt in enumerate(points):
        if pt not in pts_out:
            pts_out.append(pt)
        inds_out.append(pts_out.index(pt))
    return pts_out, inds_out
# ---------- end ct_beamsfrommeshedges ----------
item = ListItem(List=ct_beam.Beam, Index=0, Wrap=True)  # -> Item, Item1, Item2

geo_4 = Geometry([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])
# joining elements
# by topology
panel = Panel("outer")
geo_5 = Geometry([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])
ct_beam_4 = CTBeam(centerline=geo_4, width=Slider(1, range=0..1), height=Slider(2, range=0..10), category=panel)  # -> Beam, Blank; inputs centerline: list, z_vector: list of Vector3d, width: list of Double, height: list of Double, category: list of String, updateRefObj: Boolean; same code as ct_beam
ct_beam_5 = CTBeam(centerline=geo_5, width=Slider(1, range=0..1), height=Slider(2, range=0..10), category="inner")  # -> Beam, Blank; inputs centerline: list, z_vector: list of Vector3d, width: list of Double, height: list of Double, category: list of String, updateRefObj: Boolean; same code as ct_beam
data = Data([ct_beam_2.Beam, ct_beam_3.Beam])
data_2 = Data([ct_beam_4.Beam, ct_beam_5.Beam])
button = Button()

# ----
# Joint Definition
# (right click component to select/change joint type)
number_slider_2 = Slider(0.2, range=0..1)
ct_joint_rules_from_list = CTJointRulesFromList(elements=ct_beamsfrommeshedges.BeamMap)  # -> BallNodeJoint; inputs elements: list
#   port elements: Beams to join.
# ---------- ct_joint_rules_from_list: Python ----------
"""Generates a joint between beams in a list. Use a list of lists(data tree) to define multiple joints. Has same priority as direct joints."""
# r: compas==2.15.0,compas_timber==1.0.4
# venv: ca-fs26
# flake8: noqa
import inspect

import Grasshopper
import System

from compas_timber.connections import Joint
from compas_timber.connections import PlateJoint
from compas_timber.design import DirectRule
from compas_timber.ghpython.ghcomponent_helpers import get_createable_joints
from compas_timber.ghpython.ghcomponent_helpers import manage_cpython_dynamic_params
from compas_timber.ghpython.ghcomponent_helpers import rename_cpython_gh_output
from compas_timber.ghpython.ghcomponent_helpers import list_input_valid_cpython


class JointRuleFromList(Grasshopper.Kernel.GH_ScriptInstance):
    def __init__(self):
        super(JointRuleFromList, self).__init__()
        self.classes = {}
        for cls in get_createable_joints():
            if not issubclass(cls, PlateJoint):
                self.classes[cls.__name__] = cls

        self.joint_type = self.classes.get(ghenv.Component.Params.Output[0].NickName, None)

    def RunScript(self, elements: System.Collections.Generic.List[object], *args):
        if not self.joint_type:
            ghenv.Component.Message = "Select joint type from context menu (right click)"
            ghenv.Component.AddRuntimeMessage(Grasshopper.Kernel.GH_RuntimeMessageLevel.Warning, "Select joint type from context menu (right click)")
            return None
        else:
            ghenv.Component.Message = self.joint_type.__name__
            if not list_input_valid_cpython(ghenv, elements, self.arg_names[0]):
                return
            if not self.joint_type.element_count_complies(elements):
                ghenv.Component.AddRuntimeMessage(
                    Grasshopper.Kernel.GH_RuntimeMessageLevel.Warning,
                    "{} requires at least {} and at most {} elements.".format(self.joint_type.__name__, self.joint_type.MIN_ELEMENT_COUNT, self.joint_type.MAX_ELEMENT_COUNT),
                )
                return
            kwargs = {}
            for i, val in enumerate(args[1:]):
                if val is not None:
                    kwargs[self.arg_names[i]] = val

            return DirectRule(self.joint_type, [e for e in elements], **kwargs)

    @property
    def arg_start_index(self):
        if self.joint_type.MAX_ELEMENT_COUNT is None:
            return 2
        elif self.joint_type.MAX_ELEMENT_COUNT == self.joint_type.MIN_ELEMENT_COUNT:
            return self.joint_type.MAX_ELEMENT_COUNT + 1
        else:
            raise Error("I don't know how to handle this joint type")

    @property
    def arg_names(self):
        return inspect.getargspec(self.joint_type.__init__)[0][self.arg_start_index :] + ["max_distance"]

    def AppendAdditionalMenuItems(self, menu):
        for name in self.classes.keys():
            item = menu.Items.Add(name, None, self.on_item_click)
            if self.joint_type and name == self.joint_type.__name__:
                item.Checked = True

    def on_item_click(self, sender, event_info):
        self.joint_type = self.classes[str(sender)]
        rename_cpython_gh_output(self.joint_type.__name__, 0, ghenv)
        manage_cpython_dynamic_params(self.arg_names, ghenv, permanent_param_count=1)
        ghenv.Component.ExpireSolution(True)
# ---------- end ct_joint_rules_from_list ----------
ct_category_joints_rules = CTCategoryJointsRules(main_beam_category="inner", cross_beam_category="outer")  # -> TStepJoint; inputs main_beam_category: String, cross_beam_category: String
#   port main_beam_category: Beam A category.
#   port cross_beam_category: Beam B category.
#   port TStepJoint: A joint rule.
# ---------- ct_category_joints_rules: Python ----------
# r: compas==2.15.0,compas_timber==1.0.4
# venv: ca-fs26
"""Defines which Joint type will be applied in the Automatic Joints component for connecting Beams with the given Category attributes. This overrides Topological Joint rules and is overriden by Direct joint rules"""

# flake8: noqa
import inspect
from collections import OrderedDict

import Grasshopper
from System.Windows.Forms import ToolStripMenuItem
from System.Windows.Forms import ToolStripSeparator


from compas_timber.design import CategoryRule
from compas_timber.ghpython import get_createable_joints
from compas_timber.ghpython import item_input_valid_cpython
from compas_timber.ghpython import manage_cpython_dynamic_params
from compas_timber.ghpython import rename_cpython_gh_output
from compas_timber.ghpython import warning
from compas_timber.ghpython import message


class CategoryJointRule(Grasshopper.Kernel.GH_ScriptInstance):
    def __init__(self):
        super(CategoryJointRule, self).__init__()
        self.topo_bools = OrderedDict([("Unknown", False), ("I", False), ("L", False), ("T", False), ("X", False)])

        self.classes = {}
        for cls in get_createable_joints():
            self.classes[cls.__name__] = cls

        if ghenv.Component.Params.Output[0].NickName == "Rule":
            self.joint_type = None
        else:
            parsed_output = ghenv.Component.Params.Output[0].NickName.split("_")
            self.joint_type = self.classes.get(parsed_output[0])
            for key in parsed_output[1:]:
                self.topo_bools[key] = True

    @property
    def component(self):
        return ghenv.Component  # type: ignore

    def RunScript(self, *args):
        if not self.joint_type:
            warning(self.component, "Select joint type from context menu (right click)")
            return None
        else:
            message(self.component, self.joint_type.__name__)
            cat_a, cat_b = args[:2]
            kwargs = {}
            for i, val in enumerate(args[2:]):
                if val is not None:
                    kwargs[self.arg_names()[i + 2]] = val
            if not item_input_valid_cpython(ghenv, cat_a, self.arg_names()[0]) or not item_input_valid_cpython(ghenv, cat_b, self.arg_names()[1]):
                return

            topos = []
            for i, bool in enumerate(self.topo_bools.values()):
                if bool:
                    topos.append(i)

            return CategoryRule(self.joint_type, cat_a, cat_b, topos, **kwargs)

    def arg_names(self):
        names = inspect.getargspec(self.joint_type.__init__)[0][1:]
        for i in range(2):
            names[i] += "_category"
        return [name for name in names if (name != "key") and (name != "frame")] + ["max_distance"]

    def AppendAdditionalMenuItems(self, menu):
        for name in self.classes.keys():
            item = menu.Items.Add(name, None, self.on_item_click)
            if self.joint_type and name == self.joint_type.__name__:
                item.Checked = True

        menu.Items.Add(ToolStripSeparator())
        topo_menu = ToolStripMenuItem("Apply to Topology")
        menu.Items.Add(topo_menu)
        for name, bool in self.topo_bools.items():
            item = ToolStripMenuItem(name, None, self.on_topo_click)
            item.Checked = bool
            topo_menu.DropDownItems.Add(item)

    def output_name(self):
        name = self.joint_type.__name__
        for key, bool in self.topo_bools.items():
            if bool:
                name += "_{}".format(key)
        return name

    def on_topo_click(self, sender, event_info):
        self.topo_bools[str(sender)] = not self.topo_bools[str(sender)]
        rename_cpython_gh_output(self.output_name(), 0, ghenv)
        ghenv.Component.ExpireSolution(True)

    def on_item_click(self, sender, event_info):
        self.joint_type = self.classes[str(sender)]
        rename_cpython_gh_output(self.output_name(), 0, ghenv)
        manage_cpython_dynamic_params(self.arg_names(), ghenv, rename_count=2, permanent_param_count=0)
        ghenv.Component.ExpireSolution(True)
# ---------- end ct_category_joints_rules ----------
ct_category_joints_rules_2 = CTCategoryJointsRules(main_beam_category="inner", cross_beam_category="inner", cut_plane_bias=Slider(0.3, range=0..1))  # -> XLapJoint; inputs main_beam_category: String, cross_beam_category: String; same code as ct_category_joints_rules
ct_x_topological_joint_rules = CTXTopologicalJointRules()  # -> XLapJoint
#   port XLapJoint: X-Topology Rule.
# ---------- ct_x_topological_joint_rules: Python ----------
"""makes rule to apply joint type to X topology. Defualts to XLapJoint"""
# r: compas==2.15.0,compas_timber==1.0.4
# venv: ca-fs26
# flake8: noqa
import inspect

import Grasshopper


from compas_timber.connections import PlateJoint
from compas_timber.connections import JointTopology
from compas_timber.connections import XLapJoint
from compas_timber.design import TopologyRule
from compas_timber.ghpython.ghcomponent_helpers import get_createable_joints
from compas_timber.ghpython.ghcomponent_helpers import manage_cpython_dynamic_params
from compas_timber.ghpython.ghcomponent_helpers import rename_cpython_gh_output


class X_TopologyJointRule(Grasshopper.Kernel.GH_ScriptInstance):
    def __init__(self):
        super(X_TopologyJointRule, self).__init__()
        self.classes = {}
        for cls in get_createable_joints():
            supported_topo = cls.SUPPORTED_TOPOLOGY if isinstance(cls.SUPPORTED_TOPOLOGY, list) else [cls.SUPPORTED_TOPOLOGY]
            if JointTopology.TOPO_X in supported_topo and not issubclass(cls, PlateJoint):
                self.classes[cls.__name__] = cls
        self.joint_type = self.classes.get(ghenv.Component.Params.Output[0].NickName, None)

    def RunScript(self, *args):
        if not self.joint_type:
            ghenv.Component.Message = "Default: XLapJoint"
            ghenv.Component.AddRuntimeMessage(Grasshopper.Kernel.GH_RuntimeMessageLevel.Warning, "XLapJoint is default, change in context menu (right click)")
            return TopologyRule(JointTopology.TOPO_X, XLapJoint)

        ghenv.Component.Message = self.joint_type.__name__
        kwargs = {}
        for i, val in enumerate(args):
            if val is not None:
                kwargs[self.arg_names()[i]] = val
        return TopologyRule(JointTopology.TOPO_X, self.joint_type, **kwargs)

    def arg_names(self):
        names = inspect.getargspec(self.joint_type.__init__)[0][3:]
        return [name for name in names if (name != "key") and (name != "frame")] + ["max_distance"]

    def AppendAdditionalMenuItems(self, menu):
        for name in self.classes.keys():
            item = menu.Items.Add(name, None, self.on_item_click)
            if self.joint_type and name == self.joint_type.__name__:
                item.Checked = True

    def on_item_click(self, sender, event_info):
        self.joint_type = self.classes[str(sender)]
        rename_cpython_gh_output(self.joint_type.__name__, 0, ghenv)
        manage_cpython_dynamic_params(self.arg_names(), ghenv, rename_count=0, permanent_param_count=0)
        ghenv.Component.ExpireSolution(True)
# ---------- end ct_x_topological_joint_rules ----------
ct_direct_joint_rules = CTDirectJointRules(beam_a=item.Item1, beam_b=item.Item2)  # -> LMiterJoint
#   port LMiterJoint: Direct Joint Rule.
# ---------- ct_direct_joint_rules: Python ----------
# r: compas==2.15.0,compas_timber==1.0.4
# venv: ca-fs26
"""Generates a direct joint between two elements. This overrides other joint rules."""

import inspect

import Grasshopper  # type: ignore

from compas_timber.connections import PlateJoint
from compas_timber.design import DirectRule
from compas_timber.ghpython import get_createable_joints
from compas_timber.ghpython import item_input_valid_cpython
from compas_timber.ghpython import manage_cpython_dynamic_params
from compas_timber.ghpython import rename_cpython_gh_output
from compas_timber.ghpython import warning


class DirectJointRule(Grasshopper.Kernel.GH_ScriptInstance):
    def __init__(self):
        super(DirectJointRule, self).__init__()
        self.classes = {}
        for cls in get_createable_joints():
            if cls.MAX_ELEMENT_COUNT == 2 and not issubclass(cls, PlateJoint):
                self.classes[cls.__name__] = cls

        self.joint_type = self.classes.get(self.component.Params.Output[0].NickName, None)

    @property
    def component(self):
        return ghenv.Component  # type: ignore  # noqa: F821

    def RunScript(self, *args):
        if not self.joint_type:
            self.component.Message = "Select joint type from context menu (right click)"
            warning(self.component, "Select joint type from context menu (right click)")
            return None

        self.component.Message = self.joint_type.__name__
        beam_a = args[0]
        beam_b = args[1]
        if not item_input_valid_cpython(ghenv, beam_a, self.arg_names()[0]) or not item_input_valid_cpython(ghenv, beam_b, self.arg_names()[1]):
            return

        kwargs = {}
        for i, val in enumerate(args[2:]):
            if val is not None:
                kwargs[self.arg_names()[i + 2]] = val

        Rules = DirectRule(self.joint_type, [beam_a, beam_b], **kwargs)
        return Rules

    def arg_names(self):
        return inspect.getargspec(self.joint_type.__init__)[0][1:] + ["max_distance"]

    def AppendAdditionalMenuItems(self, menu):
        for name in self.classes.keys():
            item = menu.Items.Add(name, None, self.on_item_click)
            if self.joint_type and name == self.joint_type.__name__:
                item.Checked = True

    def on_item_click(self, sender, event_info):
        self.joint_type = self.classes[str(sender)]
        rename_cpython_gh_output(self.joint_type.__name__, 0, ghenv)
        manage_cpython_dynamic_params(self.arg_names(), ghenv, rename_count=2, permanent_param_count=0)
        self.component.ExpireSolution(True)
# ---------- end ct_direct_joint_rules ----------
ct_l_topological_joint_rules = CTLTopologicalJointRules()  # -> LMiterJoint
#   port LMiterJoint: L-Topology Rule.
# ---------- ct_l_topological_joint_rules: Python ----------
"""makes rule to apply joint type to L topology. Defualts to LMiterJoint"""
# r: compas==2.15.0,compas_timber==1.0.4
# venv: ca-fs26
# flake8: noqa
import inspect

import Grasshopper


from compas_timber.connections import PlateJoint
from compas_timber.connections import JointTopology
from compas_timber.connections import LMiterJoint
from compas_timber.design import TopologyRule
from compas_timber.ghpython.ghcomponent_helpers import get_createable_joints
from compas_timber.ghpython.ghcomponent_helpers import manage_cpython_dynamic_params
from compas_timber.ghpython.ghcomponent_helpers import rename_cpython_gh_output


class L_TopologyJointRule(Grasshopper.Kernel.GH_ScriptInstance):
    def __init__(self):
        super(L_TopologyJointRule, self).__init__()
        self.classes = {}
        for cls in get_createable_joints():
            supported_topo = cls.SUPPORTED_TOPOLOGY if isinstance(cls.SUPPORTED_TOPOLOGY, list) else [cls.SUPPORTED_TOPOLOGY]
            if JointTopology.TOPO_L in supported_topo and not issubclass(cls, PlateJoint):
                self.classes[cls.__name__] = cls
        self.joint_type = self.classes.get(ghenv.Component.Params.Output[0].NickName, None)

    def RunScript(self, *args):
        if not self.joint_type:
            ghenv.Component.Message = "Default: LMiterJoint"
            ghenv.Component.AddRuntimeMessage(Grasshopper.Kernel.GH_RuntimeMessageLevel.Warning, "LMiterJoint is default, change in context menu (right click)")
            return TopologyRule(JointTopology.TOPO_L, LMiterJoint)

        ghenv.Component.Message = self.joint_type.__name__
        kwargs = {}
        for i, val in enumerate(args):
            if val is not None:
                kwargs[self.arg_names()[i]] = val
        return TopologyRule(JointTopology.TOPO_L, self.joint_type, **kwargs)

    def arg_names(self):
        names = inspect.getargspec(self.joint_type.__init__)[0][3:]
        return [name for name in names if (name != "key") and (name != "frame")] + ["max_distance"]

    def AppendAdditionalMenuItems(self, menu):
        for name in self.classes.keys():
            item = menu.Items.Add(name, None, self.on_item_click)
            if self.joint_type and name == self.joint_type.__name__:
                item.Checked = True

    def on_item_click(self, sender, event_info):
        self.joint_type = self.classes[str(sender)]
        rename_cpython_gh_output(self.joint_type.__name__, 0, ghenv)
        manage_cpython_dynamic_params(self.arg_names(), ghenv, rename_count=0, permanent_param_count=0)
        ghenv.Component.ExpireSolution(True)
# ---------- end ct_l_topological_joint_rules ----------
ct_direct_joint_rules_2 = CTDirectJointRules(main_beam=item.Item, cross_beam=item.Item2, mill_depth=number_slider_2)  # -> TButtJoint; same code as ct_direct_joint_rules
ct_t_topological_joint_rules = CTTTopologicalJointRules()  # -> TButtJoint
#   port TButtJoint: T-Topology Rule..
# ---------- ct_t_topological_joint_rules: Python ----------
"""makes rule to apply joint type to T topology. Defualts to TButtJoint"""
# r: compas==2.15.0,compas_timber==1.0.4
# venv: ca-fs26
# flake8: noqa
import inspect

import Grasshopper


from compas_timber.connections import PlateJoint
from compas_timber.connections import JointTopology
from compas_timber.connections import TButtJoint
from compas_timber.design import TopologyRule
from compas_timber.ghpython.ghcomponent_helpers import get_createable_joints
from compas_timber.ghpython.ghcomponent_helpers import manage_cpython_dynamic_params
from compas_timber.ghpython.ghcomponent_helpers import rename_cpython_gh_output


class T_TopologyJointRule(Grasshopper.Kernel.GH_ScriptInstance):
    def __init__(self):
        super(T_TopologyJointRule, self).__init__()
        self.classes = {}
        for cls in get_createable_joints():
            supported_topo = cls.SUPPORTED_TOPOLOGY if isinstance(cls.SUPPORTED_TOPOLOGY, list) else [cls.SUPPORTED_TOPOLOGY]
            if JointTopology.TOPO_T in supported_topo and not issubclass(cls, PlateJoint):
                self.classes[cls.__name__] = cls
        self.joint_type = self.classes.get(ghenv.Component.Params.Output[0].NickName, None)

    def RunScript(self, *args):
        if not self.joint_type:
            ghenv.Component.Message = "Default: TButtJoint"
            ghenv.Component.AddRuntimeMessage(Grasshopper.Kernel.GH_RuntimeMessageLevel.Warning, "TButtJoint is default, change in context menu (right click)")
            return TopologyRule(JointTopology.TOPO_T, TButtJoint)

        ghenv.Component.Message = self.joint_type.__name__
        kwargs = {}
        for i, val in enumerate(args):
            if val is not None:
                kwargs[self.arg_names()[i]] = val
        return TopologyRule(JointTopology.TOPO_T, self.joint_type, **kwargs)

    def arg_names(self):
        names = inspect.getargspec(self.joint_type.__init__)[0][3:]
        return [name for name in names if (name != "key") and (name != "frame")] + ["max_distance"]

    def AppendAdditionalMenuItems(self, menu):
        for name in self.classes.keys():
            item = menu.Items.Add(name, None, self.on_item_click)
            if self.joint_type and name == self.joint_type.__name__:
                item.Checked = True

    def on_item_click(self, sender, event_info):
        self.joint_type = self.classes[str(sender)]
        rename_cpython_gh_output(self.joint_type.__name__, 0, ghenv)
        manage_cpython_dynamic_params(self.arg_names(), ghenv, rename_count=0, permanent_param_count=0)
        ghenv.Component.ExpireSolution(True)
# ---------- end ct_t_topological_joint_rules ----------

ct_category_joints_rules_3 = CTCategoryJointsRules(main_beam_category="outer", cross_beam_category="outer", modify_cross=Toggle(True))  # -> LButtJoint; inputs main_beam_category: String, cross_beam_category: String; same code as ct_category_joints_rules
data_3 = Data([ct_category_joints_rules, ct_category_joints_rules_2, ct_category_joints_rules_3])
data_4 = Data([ct_l_topological_joint_rules, ct_t_topological_joint_rules, ct_x_topological_joint_rules])

# ----
# Model
# where joinery takes place
toggle = BooleanToggle(True)
ct_model = CTModel(Elements=flatten(data_2), JointRules=flatten(data_4), CreateGeometry=Toggle(True))  # -> Model, Geometry, DebugInfo; inputs Elements: list, Containers: list, JointRules: list, Features: list, MaxDistance: Double, CreateGeometry: Boolean
#   port Elements: Collection of Beams
#   port Containers: Container elements, such as walls, floors, roofs, etc.
#   port JointRules: Collection of joint rules.
#   port Features: Collection of feature definitions.
#   port MaxDistance: Max Distance Tolerance for topology detection.
#   port CreateGeometry: If True, Beam and joint geometry is created for visualization.
#   port Model: Model object.
#   port Geometry: Geometry of the beams and joints.
#   port DebugInfo: Debug information object in the case of feature or joining errors.
# ---------- ct_model: Python ----------
# r: compas==2.15.0,compas_timber==1.0.4
# venv: ca-fs26
"""Creates an Model"""

import Grasshopper
import Rhino
import System
from compas.scene import Scene
from compas.tolerance import TOL
from compas.tolerance import Tolerance

from compas_timber.design import DebugInfomation
from compas_timber.design import JointRuleSolver
from compas_timber.design import WallPopulator
from compas_timber.elements import Beam
from compas_timber.elements import Plate
from compas_timber.errors import FeatureApplicationError
from compas_timber.ghpython import error
from compas_timber.ghpython import warning
from compas_timber.model import TimberModel

# workaround for https://github.com/gramaziokohler/compas_timber/issues/280
TOL.absolute = 1e-6


class ModelComponent(Grasshopper.Kernel.GH_ScriptInstance):
    @property
    def component(self):
        return ghenv.Component  # type: ignore

    def RunScript(self,
            Elements: System.Collections.Generic.List[object],
            Containers: System.Collections.Generic.List[object],
            JointRules: System.Collections.Generic.List[object],
            Features: System.Collections.Generic.List[object],
            MaxDistance: float,
            CreateGeometry: bool):
        # this used to be default behavior in Rhino7.. I think..
        Elements = Elements or []
        Containers = Containers or []
        JointRules = JointRules or []
        Features = Features or []

        if not Elements:
            warning(self.component, "Input parameter Beams failed to collect data")
        if not JointRules:
            warning(self.component, "Input parameter JointRules failed to collect data")
        if not (Elements or Containers):  # shows beams even if no joints are found
            return
        if MaxDistance is None:
            MaxDistance = TOL.ABSOLUTE  # compared to calculted distance, so shouldn't be just 0.0

        tol = self.get_tol()
        Model = TimberModel(tolerance=tol)
        debug_info = DebugInfomation()

        ##### Adding elements #####
        self.add_elements_to_model(Model, Elements, Containers)

        ##### Wall populating #####
        handled_pairs, wall_joints = self.handle_populators(Model, Containers, MaxDistance)

        ##### Handle joinery #####
        # checks elements compatibility and generates Joints
        JointRules = [j for j in JointRules if j is not None]

        solver = JointRuleSolver(JointRules, max_distance=MaxDistance)
        joint_errors, _ = solver.apply_rules_to_model(Model)  # TODO: figure out best way to pass out unjoined_clusters

        for je in joint_errors:
            debug_info.add_joint_error(je)

        # applies extensions and features resulting from joints
        bje = Model.process_joinery()
        if bje:
            debug_info.add_joint_error(bje)

        ##### Handle user features #####
        if Features:
            feature_errors = self.handle_features(Features)
            debug_info.add_feature_error(feature_errors)

        ##### Visualization #####
        Geometry, errors = self.handle_geometry(Model, CreateGeometry)
        for geo_error in errors:
            debug_info.add_feature_error(geo_error)

        ##### Error Handling #####
        if debug_info.has_errors:
            warning(self.component, "Error found during joint creation. See DebugInfo output for details.")

        return Model, Geometry, debug_info

    def get_tol(self):
        units = Rhino.RhinoDoc.ActiveDoc.GetUnitSystemName(True, True, True, True)
        if units == "m":
            return Tolerance(unit="M", absolute=1e-6, relative=1e-6)
        elif units == "mm":
            return Tolerance(unit="MM", absolute=1e-3, relative=1e-3)
        else:
            error(self.component, f"Unsupported unit: {units}")
            return

    def add_elements_to_model(self, model, elements, containers):
        """Adds elements to the model and groups them by slab."""
        elements = [e for e in elements if e is not None]
        for element in elements:
            element.reset()
            model.add_element(element)

        containers = [c for c in containers if c is not None]

        for index, c_def in enumerate(containers):
            slab = c_def.slab
            model.add_group_element(slab, name=slab.name + str(index))

    def handle_populators(self, model, containers, max_distance):
        # Handle wall populators
        model.connect_adjacent_walls()
        config_sets = [c_def.config_set for c_def in containers]
        populators = []
        if any(config_sets):
            populators = WallPopulator.from_model(model, config_sets)

        handled_pairs = []
        wall_joints = []
        for populator, slab in zip(populators, list(model.slabs)):
            elements = populator.create_elements()
            model.add_elements(elements, parent=slab.name)
            joint_definitions = populator.create_joints(elements, max_distance)
            wall_joints.extend(joint_definitions)
            for j_def in joint_definitions:
                element_a, element_b = j_def.elements
                handled_pairs.append({element_a, element_b})

        return handled_pairs, wall_joints

    def handle_features(self, features):
        feature_errors = []
        features = [f for f in features if f is not None]
        for f_def in features:
            if not f_def.elements:
                warning(self.component, "Features defined in model must have elements defined. Features without elements will be ignored")
                continue

            for element in f_def.elements:
                try:
                    element.add_features(f_def.feature_from_element(element))
                except FeatureApplicationError as ex:
                    feature_errors.append(ex)
        return feature_errors

    def handle_geometry(self, Model, CreateGeometry):
        scene = Scene()
        errors = []
        for element in Model.elements():
            if CreateGeometry:
                scene.add(element.geometry)
                if getattr(element, "debug_info", False):
                    errors.append(element.debug_info)
            else:
                if isinstance(element, Beam):
                    scene.add(element.blank)
                elif isinstance(element, Plate):
                    scene.add(element.shape)
                else:
                    scene.add(element.geometry)
        return scene.draw(), errors
# ---------- end ct_model ----------
ct_model_2 = CTModel(Elements=flatten(ct_beamsfrommeshedges.Beams), JointRules=flatten(ct_joint_rules_from_list), CreateGeometry=Toggle(True))  # -> Model, Geometry, DebugInfo; inputs Elements: list, Containers: list, JointRules: list, Features: list, MaxDistance: Double, CreateGeometry: Boolean; same code as ct_model
ct_model_3 = CTModel(
    Elements=flatten(ct_beam.Beam),
    JointRules=flatten([ct_direct_joint_rules_2, ct_direct_joint_rules]),
    CreateGeometry=toggle)  # -> Model, Geometry, DebugInfo; inputs Elements: list, Containers: list, JointRules: list, Features: list, MaxDistance: Double, CreateGeometry: Boolean; same code as ct_model
ct_model_4 = CTModel(Elements=flatten(data), JointRules=flatten(data_3), CreateGeometry=Toggle(True))  # -> Model, Geometry, DebugInfo; inputs Elements: list, Containers: list, JointRules: list, Features: list, MaxDistance: Double, CreateGeometry: Boolean; same code as ct_model
