# Grasshopper definition example-01-eccentricity.ghx (Grasshopper 1.0.8)

# ---- group: Centerline eccentricity
# Eccentricity Examples
# Gramazio Kohler Research
# Gonzalo Casas, Lorin Wiedemeier, Eric Gozzi
centerlines = Python3Script(eccentricity=Slider(0, range=0..1), cell_size=Slider(4, range=0..20), cell_count=Slider(5, range=0..20))  # -> lines; inputs cell_size: Int32, cell_count: Int32
# ---------- centerlines: Python ----------
# r: compas==2.15.0,compas_timber==1.0.4
# venv: ca-fs26

from compas_rhino.devtools import DevTools
DevTools.ensure_path()

# ------ IMPORTS -------

import scriptcontext as sc
import Grasshopper as gh

from compas.datastructures import Mesh
from compas_rhino.conversions import line_to_rhino

# --------------------------------------------------
# ------------------- EXECUTION --------------------

# 1. Init
mesh = Mesh.from_meshgrid(cell_size, cell_count)

# 2. Functions to compute edge data
def compute_edge_data(mesh, edge):
    next_edge = _compute_next_rf_edge(mesh, edge)
    prev_edge = _compute_prev_rf_edge(mesh, edge)

    mesh.edge_attribute(edge, "next_edge", next_edge)
    mesh.edge_attribute(edge, "prev_edge", prev_edge)

    centerline = mesh.edge_attribute(edge, "centerline") or mesh.edge_line(edge)
    
    return next_edge, prev_edge, centerline

def _compute_next_rf_edge(mesh, edge):
    face = mesh.halfedge_face(edge)
    halfedges = mesh.face_halfedges(face)
    index = halfedges.index(edge)
    return halfedges[(index + 1) % len(halfedges)]

def _compute_prev_rf_edge(mesh, edge):
    reversed_edge = (edge[1], edge[0])
    return _compute_next_rf_edge(mesh, reversed_edge)

# 3. Generate eccentric lines
def eccentrize_centerlines(mesh, eccentricity: float):
    for edge in mesh.edges():
        if mesh.is_edge_on_boundary(edge):
            continue

        next_edge, prev_edge, centerline = compute_edge_data(mesh, edge)

        # 3.1. Calculate eccentricity
        next_direction = mesh.edge_direction(next_edge).unitized()
        prev_direction = mesh.edge_direction(prev_edge).unitized()

        start_shift = prev_direction * eccentricity
        end_shift = (-start_shift) + next_direction * eccentricity

        centerline.start += start_shift
        centerline.end += end_shift

        # 3.2. Store results in edge attribute
        mesh.edge_attribute(edge, "centerline", centerline)


# 4. Call main eccentrize function
eccentrize_centerlines(mesh, eccentricity)

# ------------------- OUTPUT --------------------

lines = []
for edge in mesh.edges():
    centerline = mesh.edge_attribute(edge, "centerline")
    if not centerline:
        continue
    lines.append(line_to_rhino(centerline))
# ---------- end centerlines ----------

# ----
reloader = CompasDevReloader()
# ---------- reloader: Python ----------
"""
------------------------------
Using VS Code as Python editor
------------------------------

The simplest way to start using VS Code as our editor, is
to place our Python code in files located IN THE SAME FOLDER as our Grasshopper file.

After we have done that, we need 2 steps: 

1. Enable the COMPAS reloader on one component. This tells Grasshopper to watch for changes in the Pythoh files and reload if changed.
2. Every other component that uses Python code from external files needs to start with a method to ensure Grasshopper knows where to load the files from.

"""
# r: compas==2.15.0,compas_timber==1.0.4
# venv: ca-fs26

from compas_rhino.devtools import DevTools
DevTools.enable_reloader()
# ---------- end reloader ----------
