# Grasshopper definition example-02-relaxation.ghx (Grasshopper 1.0.8)

# ---- group: Iterative / Live updates
iterative_live = Python3Script(reset=Button(), on=Toggle(False))  # -> mesh
# ---------- iterative_live: Python ----------
# r: compas==2.15.0,compas_timber==1.0.4
# venv: ca-fs26

from compas_rhino.devtools import DevTools
DevTools.ensure_path()

# ------ IMPORTS -------

import scriptcontext as sc
import Grasshopper as gh

from compas.datastructures import Mesh

from compas_ghpython import create_id
from compas_ghpython.timer import update_component
from compas_rhino.conversions import mesh_to_rhino

from example_02 import compute_forces, compute_gravity, apply_forces

# --------------------------------------------------
# ------------------- EXECUTION --------------------


key = create_id(ghenv.Component, "mesh")

# 1. Initialize or Reset
if reset or key not in sc.sticky:
    mesh = Mesh.from_meshgrid(10, 10)
    mesh.attributes["step"] = 0

    sc.sticky[key] = mesh
    ghenv.Component.Message = "Mesh smoothing"

# 2. Retrieve state
mesh = sc.sticky[key]

# 3. Run step
if on:
    compute_forces(mesh, damping=0.1)
    compute_gravity(mesh)

    apply_forces(mesh)

    mesh.attributes["step"] += 1
    ghenv.Component.Message = f"Mesh smoothing\nstep #{mesh.attributes['step']}"
    update_component(ghenv, 20)

mesh = mesh_to_rhino(mesh)
# ---------- end iterative_live ----------

# ---- group: Batch processing
# Iterative Algorithm Examples
# Gramazio Kohler Research
# Gonzalo Casas, Lorin Wiedemeier, Eric Gozzi
iterative_basic = Python3Script(iters=Slider(12, range=1..100))  # -> mesh; inputs iters: Int32
# ---------- iterative_basic: Python ----------
# r: compas==2.15.0,compas_timber==1.0.4
# venv: ca-fs26

from compas_rhino.devtools import DevTools
DevTools.ensure_path()

# ------ IMPORTS -------

import scriptcontext as sc
import Grasshopper as gh

from compas.datastructures import Mesh
from compas_rhino.conversions import mesh_to_rhino

from example_02 import compute_forces, compute_gravity, apply_forces


# --------------------------------------------------
# ------------------- EXECUTION --------------------

mesh = Mesh.from_meshgrid(10, 10)

for _ in range(iters):
    compute_forces(mesh, damping=0.1)
    compute_gravity(mesh)

    apply_forces(mesh)

mesh = mesh_to_rhino(mesh)
# ---------- end iterative_basic ----------

# ----
reloader = CompasDevReloader()
# ---------- reloader: Python ----------
"""
------------------------------
Using VS Code as Python editor
------------------------------

The simplest way to start using VS Code as our editor, is
to place our Python code in files located IN THE SAME FOLDER as our Grasshopper file.

After we have done that, we need 2 steps: 

1. Enable the COMPAS reloader on one component. This tells Grasshopper to watch for changes in the Pythoh files and reload if changed.
2. Every other component that uses Python code from external files needs to start with a method to ensure Grasshopper knows where to load the files from.

"""
# r: compas==2.15.0,compas_timber==1.0.4
# venv: ca-fs26

from compas_rhino.devtools import DevTools
DevTools.enable_reloader()
# ---------- end reloader ----------
