# Grasshopper definition example-01-attractors.ghx (Grasshopper 1.0.8)

point = Point(Point(3.629154386, 5.326845136, 1.047049932))
# Attractors
# Gramazio Kohler Research
# Gonzalo Casas, Lorin Wiedemeier, Eric Gozzi
simple_attractors = Python3Script(point=point, attraction_force=Slider(0.068, range=0..0.1))  # -> boxes; inputs point: Point3d
# ---------- simple_attractors: Python ----------
# r: compas==2.15.0,compas_timber==1.0.4
# venv: ca-fs26

from compas_rhino.devtools import DevTools
DevTools.ensure_path()

# ------ IMPORTS -------

from compas.geometry import Box
from compas.geometry import Point
from compas_rhino.conversions import box_to_rhino
from compas_rhino.conversions import point_to_compas

# --------------------------------------------------
# ------------------- EXECUTION --------------------

# 1. Get the points from Rhino and convert to COMPAS (hint: function point_to_compas())
attractor = point_to_compas(point)

# 2. Create an empty list for the boxes
boxes = []

# 3. Create a grid using a nested for loop of two range() functions
for x in range(10):
    for y in range(10):

        # 4. Create a point at x, y and use 0 for z
        point = Point(x, y, 0)
        
        # 5. Calculate the distance from the attractor point
        # .. to the one just created above (hint: points have a method called .distance_to_point())
        distance = attractor.distance_to_point(point)

        # 6. Calculate the size of the box using distance multipled by an attraction force factor
        size = distance * attraction_force

        # 7. Create a box using the size
        box = Box.from_width_height_depth(size, size, size)

        # 8. Assign the point of the box's frame to the point you have created above
        box.frame.point = point
        
        # 9. Append to the list of boxes
        boxes.append(box_to_rhino(box))
# ---------- end simple_attractors ----------

point_2 = Point(Point(3.754422853, 2.004900706, 1.047049932))
point_3 = Point(Point(7.485378624, 8.197109329, -1.377344059))
merge = Merge(Data1=point_2, Data2=point_3)
multiple_attractors = Python3Script(points=merge, attraction_force=Slider(0.086, range=0..0.1))  # -> boxes; inputs points: list of Point3d
# ---------- multiple_attractors: Python ----------
# r: compas==2.15.0,compas_timber==1.0.4
# venv: ca-fs26

from compas_rhino.devtools import DevTools
DevTools.ensure_path()

# ------ IMPORTS -------

from compas.geometry import Box
from compas.geometry import Point
from compas_rhino.conversions import box_to_rhino
from compas_rhino.conversions import point_to_compas

# --------------------------------------------------
# ------------------- EXECUTION --------------------

# 1. Get the points from Rhino and convert to COMPAS (hint: function point_to_compas())
attractors = []
for point in points:
    attractors.append(point_to_compas(point))

# 2. Create an empty list for the boxes
boxes = []

# 3. Create a grid using a nested for loop of two range() functions
for x in range(10):
    for y in range(10):

        # 4. Create a point at x, y and use 0 for z
        point = Point(x, y, 0)
        
        # 5. Calculate the influence as min distance from the box to all attractor points
        # Option A: Minimum distance
        influences = []
        for attractor in attractors:
            influences.append(point.distance_to_point(attractor))
        influence = min(influences)

        # Option B: Sum of inverse distances
        # influence = 0
        # multiplier = 20
        # for attractor in attractors:
        #     distance = point.distance_to_point(attractor)
        #     influence += (1 / (distance ** 2 + 0.001)) * multiplier
        
        # 6. Use the influence value multipled by an attraction force factor to determine size
        size = influence * attraction_force

        # 7. Create a box using the size
        box = Box.from_width_height_depth(size, size, size)

        # 8. Assign the point of the box's frame to the point you have created above
        box.frame.point = point
        
        # 9. Append to the list of boxes
        boxes.append(box_to_rhino(box))
# ---------- end multiple_attractors ----------

reloader = CompasDevReloader()
# ---------- reloader: Python ----------
"""
------------------------------
Using VS Code as Python editor
------------------------------

The simplest way to start using VS Code as our editor, is
to place our Python code in files located IN THE SAME FOLDER as our Grasshopper file.

After we have done that, we need 2 steps: 

1. Enable the COMPAS reloader on one component. This tells Grasshopper to watch for changes in the Pythoh files and reload if changed.
2. Every other component that uses Python code from external files needs to start with a method to ensure Grasshopper knows where to load the files from.

"""
# r: compas==2.15.0,compas_timber==1.0.4
# venv: ca-fs26

from compas_rhino.devtools import DevTools
DevTools.enable_reloader()
# ---------- end reloader ----------
