# Grasshopper definition example-02-attractor-modifiers.ghx (Grasshopper 1.0.8)

# ---- group: Iterative / Live updates
point = Point(Point(1.181209641, 3.66361262, 1.047049932))
point_2 = Point(Point(6.854899756, 6.972025776, -1.377344059))
merge = Merge(Data1=point, Data2=point_2)
# Attractors & Modifiers
# Gramazio Kohler Research
# Gonzalo Casas, Lorin Wiedemeier, Eric Gozzi
iterative_live = Python3Script(points=merge, attraction_force=Slider(0.0024, range=-0.06..0.06), reset=Button(), on=Toggle(False))  # -> mesh; inputs points: list of Point3d
# ---------- iterative_live: Python ----------
# r: compas==2.15.0,compas_timber==1.0.4
# venv: ca-fs26

from compas_rhino.devtools import DevTools
DevTools.ensure_path()

# ------ IMPORTS -------

import scriptcontext as sc
import Grasshopper as gh

from compas.datastructures import Mesh

from compas_ghpython import create_id
from compas_ghpython.timer import update_component
from compas_rhino.conversions import mesh_to_rhino
from compas_rhino.conversions import point_to_compas

from example_02 import compute_forces, compute_gravity, compute_attractors, apply_forces

# --------------------------------------------------
# ------------------- EXECUTION --------------------

key = create_id(ghenv.Component, "mesh")

# 0. Convert input points to COMPAS points
attractor_points = []
for p in points:
    attractor_points.append(point_to_compas(p))

# 1. Initialize or Reset
if reset or key not in sc.sticky:
    mesh = Mesh.from_meshgrid(10, 10)
    mesh.attributes["step"] = 0

    sc.sticky[key] = mesh
    ghenv.Component.Message = "Mesh smoothing"

# 2. Retrieve state
mesh = sc.sticky[key]

# 3. Run step
if on:
    compute_forces(mesh, damping=0.1)
    compute_gravity(mesh)
    compute_attractors(mesh, attractor_points, attraction_force)

    apply_forces(mesh)

    mesh.attributes["step"] += 1
    ghenv.Component.Message = f"Mesh smoothing\nstep #{mesh.attributes['step']}"
    update_component(ghenv, 20)

mesh = mesh_to_rhino(mesh, disjoint=False)
# ---------- end iterative_live ----------

# ----
reloader = CompasDevReloader()
# ---------- reloader: Python ----------
"""
------------------------------
Using VS Code as Python editor
------------------------------

The simplest way to start using VS Code as our editor, is
to place our Python code in files located IN THE SAME FOLDER as our Grasshopper file.

After we have done that, we need 2 steps: 

1. Enable the COMPAS reloader on one component. This tells Grasshopper to watch for changes in the Pythoh files and reload if changed.
2. Every other component that uses Python code from external files needs to start with a method to ensure Grasshopper knows where to load the files from.

"""
# r: compas==2.15.0,compas_timber==1.0.4
# venv: ca-fs26

from compas_rhino.devtools import DevTools
DevTools.enable_reloader()
# ---------- end reloader ----------
