# Grasshopper definition example-03-relax-visualisation.ghx (Grasshopper 1.0.8)
# Copyright: Lorin Wiedemeier

flat_sample_mesh = Python3Script()  # -> mesh
# ---------- flat_sample_mesh: Python ----------
from compas.datastructures import Mesh
mesh = Mesh.from_meshgrid(10, 10)
# ---------- end flat_sample_mesh ----------

# ---- group: Force Explorer - Per Vertex
python_3_script = Python3Script(mesh=flat_sample_mesh)  # -> a
# ---------- python_3_script: Python ----------
# r: compas==2.15.0,compas_timber==1.0.4
# venv: ca-fs26
from rhinoscriptsyntax import coercegeometry

import System
from compas.datastructures import Mesh
from compas.geometry import Brep

from compas_rhino.conversions import mesh_to_rhino
from compas_rhino.conversions import mesh_to_compas

def ensure_compas_mesh(x):
    if mesh is None:
        return None

    # 1. If it's already a COMPAS Mesh, just return it
    if isinstance(mesh, Mesh):
        return mesh

    # 2. If it's a Guid
    if isinstance(mesh, System.Guid):
        # 2.1 Try to coerce and convert to mesh
        try:
            return mesh_to_compas(coercegeometry(mesh))
        except AttributeError:
            # 2.2 Try to mesh from Brep
            brep = Brep.from_native(coercegeometry(mesh))
            meshes = brep.to_meshes()
            return meshes[0]

    return None

# Execution
a = ensure_compas_mesh(mesh)
# ---------- end python_3_script ----------
# Mesh Relax Visualizer Components
# Gramazio Kohler Research
# Gonzalo Casas, Lorin Wiedemeier, Eric Gozzi
compas_draw = COMPASDraw(cg=python_3_script)  # -> rg
#   port cg: The COMPAS geometry or datastructure to be drawn.
#   port rg: The Rhino geometry object.
# ---------- compas_draw: Python ----------
# r: compas>=2.14.1
"""
Draws COMPAS geometry in Grasshopper.
"""

from typing import Any

import Grasshopper

from compas.scene import SceneObject


class CompasToRhinoGeometry(Grasshopper.Kernel.GH_ScriptInstance):
    def RunScript(self, cg):
        if not cg:
            return None

        return SceneObject(item=cg).draw()
# ---------- end compas_draw ----------
py_compas = CompasPyTemplate(
    mesh=python_3_script,
    v_index=Slider(5, range=0..100),
    damping=Slider(2.5, range=0..10),
    gravity=Slider(0.18, range=-1..1),
    scale_forces=Slider(2.81, range=0..6),
    tip_to_tail=Toggle(False),
    bake=Button())  # inputs v_index: Int32, damping: Double, gravity: Double, scale_forces: Double, tip_to_tail: Boolean, bake: Boolean
# ---------- py_compas: Python ----------
"""Grasshopper Script Instance"""
import System
import Rhino
import Rhino.Geometry
import Grasshopper

from compas.geometry import Point, Vector
from compas_rhino.conversions import point_to_rhino, vector_to_rhino

class MeshRelaxDisplay(Grasshopper.Kernel.GH_ScriptInstance):

    def RunScript(self,
            mesh,
            v_index: int,
            damping: float,
            gravity: float,
            scale_forces: float,
            tip_to_tail: bool,
            bake: bool):
        
        self._lines = []        
        self._arrows = [] 
        self._dots = []  
        
        if not mesh or v_index is None: return
        
        # Color definitions
        color_total = System.Drawing.Color.FromArgb(255, 45, 120, 45) # Semi-dark Green
        color_internal = System.Drawing.Color.DodgerBlue
        color_grav = System.Drawing.Color.Firebrick
        color_edges = System.Drawing.Color.DarkSeaGreen
        
        # 1. SETUP
        v_keys = list(mesh.vertices())
        if v_index < 0 or v_index >= len(v_keys): return
        
        v_key = v_keys[v_index]
        vp = mesh.vertex_point(v_key)
        rh_vp = point_to_rhino(vp)
        
        neighbors = mesh.vertex_neighbors(v_key)
        num_nbrs = len(neighbors)
        if num_nbrs == 0: return

        # 2. VECTOR ADDITION (Internal / Smoothing)
        internal_sum = Vector(0, 0, 0)
        current_rh_origin = rh_vp 
        
        for nbr in neighbors:
            nbr_pt = mesh.vertex_point(nbr)
            rh_nbr = point_to_rhino(nbr_pt)
            
            # Edge reference line
            self._lines.append((Rhino.Geometry.Line(rh_vp, rh_nbr), System.Drawing.Color.FromArgb(40, 0,0,0), 1))
            self._dots.append(("", rh_nbr, System.Drawing.Color.Black, 3.0)) 
            self._dots.append(("", rh_nbr, System.Drawing.Color.White, 1.5)) 
            
            edge_vec = Vector.from_start_end(vp, nbr_pt)
            force_contribution = edge_vec * edge_vec.length * (damping / num_nbrs)
            internal_sum += force_contribution
            
            rh_edge_f = vector_to_rhino(force_contribution) * scale_forces
            start_pt = current_rh_origin if tip_to_tail else rh_vp
            end_pt = start_pt + rh_edge_f
            
            if rh_edge_f.Length > 0.001:
                self._arrows.append((Rhino.Geometry.Line(start_pt, end_pt), color_edges, 2, 0.1))
            if tip_to_tail:
                current_rh_origin = end_pt

        # 3. RESULTANTS LOGIC
        gravity_vec = Vector(0, 0, -gravity)
        total_force = internal_sum + gravity_vec
        
        rh_int = vector_to_rhino(internal_sum) * scale_forces
        rh_grav = vector_to_rhino(gravity_vec) * scale_forces
        rh_total = vector_to_rhino(total_force) * scale_forces

        # CASE: Gravity exists
        if abs(gravity) > 1e-6:
            # Show Internal Sum in Blue
            self._arrows.append((Rhino.Geometry.Line(rh_vp, rh_vp + rh_int), color_internal, 4, 0.15))
            
            # Show Gravity in Red
            grav_start = (rh_vp + rh_int) if tip_to_tail else rh_vp
            self._arrows.append((Rhino.Geometry.Line(grav_start, grav_start + rh_grav), color_grav, 4, 0.15))
            
            # Show Final Total in Green
            tip_pt = rh_vp + rh_total
            self._arrows.append((Rhino.Geometry.Line(rh_vp, tip_pt), color_total, 4, 0.25))
            self._dots.append(("TOTAL F: {:.4f}".format(total_force.length), tip_pt, color_total, 18))
            
        # CASE: Pure Smoothing (Gravity is 0)
        else:
            # Hide the Blue/Red components, Green becomes the only resultant
            tip_pt = rh_vp + rh_total
            self._arrows.append((Rhino.Geometry.Line(rh_vp, tip_pt), color_total, 8, 0.25))
            self._dots.append(("SMOOTH F: {:.4f}".format(total_force.length), tip_pt, color_total, 18))

        # Labels
        self._dots.append((str(v_key), rh_vp, System.Drawing.Color.Black, 20))

        if bake:
            self.bake_visuals(rh_vp, rh_int, rh_grav, rh_total, color_total, tip_to_tail)

    def bake_visuals(self, origin, v_int, v_grav, v_tot, col_tot, tip_to_tail):
        doc = Rhino.RhinoDoc.ActiveDoc
        
        def get_or_create_layer(full_path, color):
            # Split path by double colon
            parts = full_path.split("::")
            parent_id = System.Guid.Empty
            current_path = ""
            layer_index = -1
            
            for part in parts:
                if current_path:
                    current_path += "::" + part
                else:
                    current_path = part
                
                # Check if this specific level exists
                found_idx = doc.Layers.FindByFullPath(current_path, -1)
                if found_idx >= 0:
                    layer_index = found_idx
                    parent_id = doc.Layers[found_idx].Id
                else:
                    # Create the layer at this level
                    new_layer = Rhino.DocObjects.Layer()
                    new_layer.Name = part
                    new_layer.ParentLayerId = parent_id
                    new_layer.Color = color
                    layer_index = doc.Layers.Add(new_layer)
                    parent_id = doc.Layers[layer_index].Id
            
            return layer_index

        def add_simple_line(start, end, name, col):
            if start.DistanceTo(end) < 1e-6: return
            
            # Use the recursive helper to get the nested index
            full_layer_path = "Relax_Explorer::" + name
            idx = get_or_create_layer(full_layer_path, col)
            
            attr = Rhino.DocObjects.ObjectAttributes()
            attr.LayerIndex = idx
            attr.ColorSource = Rhino.DocObjects.ObjectColorSource.ColorFromLayer
            
            line_geom = Rhino.Geometry.Line(start, end)
            doc.Objects.AddLine(line_geom, attr)
            doc.Objects.AddTextDot(name, end, attr)

        # 1. Bake Edge Forces (The chain)
        edge_col = System.Drawing.Color.DarkSeaGreen
        for line, color, thick, head in self._arrows:
            if color.ToArgb() == edge_col.ToArgb():
                add_simple_line(line.From, line.To, "Edge_Force", edge_col)

        # 2. Bake Internal Resultant (Blue)
        add_simple_line(origin, origin + v_int, "Internal_Sum", System.Drawing.Color.DodgerBlue)
        
        # 3. Bake Gravity (Red)
        g_start = (origin + v_int) if tip_to_tail else origin
        add_simple_line(g_start, g_start + v_grav, "Gravity", System.Drawing.Color.Firebrick)
        
        # 4. Bake Total Resultant (Green)
        add_simple_line(origin, origin + v_tot, "TOTAL_RESULTANT", col_tot)

        doc.Views.Redraw()

    def DrawViewportWires(self, args):
        for line, color, thick in self._lines:
            args.Display.DrawLine(line, color, thick)
        for line, color, thick, head_size in self._arrows:
            args.Display.DrawLine(line, color, thick)
            args.Display.DrawArrow(line, color, 0, head_size)

    def DrawViewportMeshes(self, args):
        for text, pt, color, size in self._dots:
            if text: args.Display.Draw2dText(text, color, pt, True, size)
            else: args.Display.DrawPoint(pt, Rhino.Display.PointStyle.Circle, size, color)
# ---------- end py_compas ----------

# ---- group: Force Explorer - Force Field
python_3_script_2 = Python3Script()  # -> a; same code as python_3_script
compas_draw_2 = COMPASDraw(cg=python_3_script_2)  # -> rg; same code as compas_draw
py_compas_2 = CompasPyTemplate(
    mesh=python_3_script_2,
    damping=Slider(2, range=0..10),
    gravity=Slider(0.08, range=-1..1),
    scale_forces=Slider(2.53, range=0..6),
    bake=Button())  # inputs damping: Double, gravity: Double, scale_forces: Double, bake: Boolean
# ---------- py_compas_2: Python ----------
"""Grasshopper Script Instance"""
import System
import Rhino
import Rhino.Geometry
import Grasshopper

from compas.geometry import Point, Vector
from compas_rhino.conversions import point_to_rhino, vector_to_rhino

class ForceFieldExplorer(Grasshopper.Kernel.GH_ScriptInstance):

    def RunScript(self,
            mesh,
            damping: float,
            gravity: float,
            scale_forces: float,
            bake: bool):
        
        self.Message = "Global Force Field"
        self._arrows = [] # (Line, Color, Thick, HeadSize)
        self._dots = []   
        
        if not mesh: return
        
        # Colors
        self._color_total = System.Drawing.Color.FromArgb(255, 45, 120, 45) # Dark Green
        self._color_edges = System.Drawing.Color.DarkSeaGreen
        
        d = damping if damping is not None else 0.1
        g = gravity if gravity is not None else 0.0
        s = scale_forces if scale_forces is not None else 1.0

        for v_key in mesh.vertices():
            vp = mesh.vertex_point(v_key)
            rh_vp = point_to_rhino(vp)
            
            neighbors = mesh.vertex_neighbors(v_key)
            num_nbrs = len(neighbors)
            
            if num_nbrs < 3:
                self._dots.append(("", rh_vp, System.Drawing.Color.Black, 1.5))
                continue

            # 1. CALCULATE INTERNAL & INDIVIDUAL EDGES
            internal_sum = Vector(0, 0, 0)
            for nbr in neighbors:
                nbr_pt = mesh.vertex_point(nbr)
                edge_vec = Vector.from_start_end(vp, nbr_pt)
                contribution = edge_vec * edge_vec.length * (d / num_nbrs)
                internal_sum += contribution
                
                # Visual Edge Arrow
                rh_edge_f = vector_to_rhino(contribution) * s
                if rh_edge_f.Length > 0.001:
                    self._arrows.append((Rhino.Geometry.Line(rh_vp, rh_vp + rh_edge_f), self._color_edges, 1, 0.1))

            # 2. CALCULATE TOTAL
            gravity_vec = Vector(0, 0, -g)
            total_force = internal_sum + gravity_vec
            
            # 3. CREATE TOTAL RESULTANT ARROW
            rh_total = vector_to_rhino(total_force) * s
            if rh_total.Length > 0.001:
                self._arrows.append((Rhino.Geometry.Line(rh_vp, rh_vp + rh_total), self._color_total, 2, 0.15))

        if bake:
            self.bake_field()

    def get_or_create_layer(self, full_path, color):
        doc = Rhino.RhinoDoc.ActiveDoc
        parts = full_path.split("::")
        parent_id = System.Guid.Empty
        current_path = ""
        layer_index = -1
        
        for part in parts:
            current_path = current_path + "::" + part if current_path else part
            found_idx = doc.Layers.FindByFullPath(current_path, -1)
            if found_idx >= 0:
                layer_index = found_idx
                parent_id = doc.Layers[found_idx].Id
            else:
                new_layer = Rhino.DocObjects.Layer()
                new_layer.Name = part
                new_layer.ParentLayerId = parent_id
                new_layer.Color = color
                layer_index = doc.Layers.Add(new_layer)
                parent_id = doc.Layers[layer_index].Id
        return layer_index

    def bake_field(self):
        doc = Rhino.RhinoDoc.ActiveDoc
        
        def add_baked_line(line, name, col):
            idx = self.get_or_create_layer("Global_Force_Field::" + name, col)
            attr = Rhino.DocObjects.ObjectAttributes()
            attr.LayerIndex = idx
            attr.ColorSource = Rhino.DocObjects.ObjectColorSource.ColorFromLayer
            doc.Objects.AddLine(line, attr)

        for line, col, thick, head in self._arrows:
            if col.ToArgb() == self._color_total.ToArgb():
                add_baked_line(line, "Resultants", col)
            else:
                add_baked_line(line, "Edge_Components", col)
        
        doc.Views.Redraw()

    def DrawViewportWires(self, args):
        for line, color, thick, head_size in self._arrows:
            args.Display.DrawLine(line, color, thick)
            args.Display.DrawArrow(line, color, 0, head_size)

    def DrawViewportMeshes(self, args):
        for text, pt, color, size in self._dots:
            args.Display.DrawPoint(pt, Rhino.Display.PointStyle.Circle, size, color)
# ---------- end py_compas_2 ----------

# ----
reloader = CompasDevReloader()
# ---------- reloader: Python ----------
"""
------------------------------
Using VS Code as Python editor
------------------------------

The simplest way to start using VS Code as our editor, is
to place our Python code in files located IN THE SAME FOLDER as our Grasshopper file.

After we have done that, we need 2 steps: 

1. Enable the COMPAS reloader on one component. This tells Grasshopper to watch for changes in the Pythoh files and reload if changed.
2. Every other component that uses Python code from external files needs to start with a method to ensure Grasshopper knows where to load the files from.

"""
# r: compas==2.15.0,compas_timber==1.0.4
# venv: ca-fs26

from compas_rhino.devtools import DevTools
DevTools.enable_reloader()
# ---------- end reloader ----------
