# Grasshopper definition example-04-modifiers.ghx (Grasshopper 1.0.8)

unit_x = UnitX(Factor=1)
dfm = Python3Script(vector=unit_x, attraction_force=Slider(0.0024, range=-0.06..0.06))  # -> modifier; inputs vector: Vector3d
# ---------- dfm: Python ----------
# r: compas==2.15.0,compas_timber==1.0.4
# venv: ca-fs26

from compas_rhino.devtools import DevTools
DevTools.ensure_path()

# ------ IMPORTS -------

from compas_rhino.conversions import vector_to_compas
from example_04 import DirectionalForceModifier

# --------------------------------------------------
# ------------------- EXECUTION --------------------

vector = vector_to_compas(vector)
modifier = DirectionalForceModifier(vector, attraction_force)
# ---------- end dfm ----------
reloader = CompasDevReloader()
# ---------- reloader: Python ----------
"""
------------------------------
Using VS Code as Python editor
------------------------------

The simplest way to start using VS Code as our editor, is
to place our Python code in files located IN THE SAME FOLDER as our Grasshopper file.

After we have done that, we need 2 steps: 

1. Enable the COMPAS reloader on one component. This tells Grasshopper to watch for changes in the Pythoh files and reload if changed.
2. Every other component that uses Python code from external files needs to start with a method to ensure Grasshopper knows where to load the files from.

"""
# r: compas==2.15.0,compas_timber==1.0.4
# venv: ca-fs26

from compas_rhino.devtools import DevTools
DevTools.enable_reloader()
# ---------- end reloader ----------

# ---- group: Iterative / Live updates
point = Point(Point(1.181209641, 3.66361262, 1.047049932))
number_slider = Slider(0.0035, range=-0.06..0.06)
point_2 = Point(Point(7.2916724, 6.972025776, -0.06809590112))

# ----
apm = Python3Script(point=point, attraction_force=number_slider)  # -> modifier; inputs point: Point3d
# ---------- apm: Python ----------
# r: compas==2.15.0,compas_timber==1.0.4
# venv: ca-fs26

from compas_rhino.devtools import DevTools
DevTools.ensure_path()

# ------ IMPORTS -------

from compas_rhino.conversions import point_to_compas
from example_04 import AttractorPointModifier

# --------------------------------------------------
# ------------------- EXECUTION --------------------

point = point_to_compas(point)
modifier = AttractorPointModifier(point, attraction_force)
# ---------- end apm ----------
apm_2 = Python3Script(point=point_2, attraction_force=Slider(0.0024, range=-0.06..0.06))  # -> modifier; inputs point: Point3d; same code as apm

# ---- group: Iterative / Live updates (continued)
merge = Merge(Data1=apm, Data2=apm_2, Data3=dfm)
# Attractors & Modifiers
# Gramazio Kohler Research
# Gonzalo Casas, Lorin Wiedemeier, Eric Gozzi
iterative_live = Python3Script(modifiers=merge, reset=Button(), on=Toggle(False))  # -> mesh; inputs modifiers: list
# ---------- iterative_live: Python ----------
# r: compas==2.15.0,compas_timber==1.0.4
# venv: ca-fs26

from compas_rhino.devtools import DevTools
DevTools.ensure_path()

# ------ IMPORTS -------

import scriptcontext as sc
import Grasshopper as gh

from compas.datastructures import Mesh

from compas_ghpython import create_id
from compas_ghpython.timer import update_component
from compas_rhino.conversions import mesh_to_rhino

from example_02 import compute_forces, compute_gravity, apply_forces

# --------------------------------------------------
# ------------------- EXECUTION --------------------

key = create_id(ghenv.Component, "mesh")

# 1. Initialize or Reset
if reset or key not in sc.sticky:
    mesh = Mesh.from_meshgrid(10, 10)
    mesh.attributes["step"] = 0

    sc.sticky[key] = mesh
    ghenv.Component.Message = "Mesh smoothing"

# 2. Retrieve state
mesh = sc.sticky[key]

# 3. Run step
if on:
    compute_forces(mesh, damping=0.1)
    compute_gravity(mesh)

    for modifier in modifiers:
        modifier.apply(None, mesh)

    apply_forces(mesh)

    mesh.attributes["step"] += 1
    ghenv.Component.Message = f"Mesh smoothing\nstep #{mesh.attributes['step']}"
    update_component(ghenv, 20)

mesh = mesh_to_rhino(mesh, disjoint=False)
# ---------- end iterative_live ----------
